# Grasshopper definition Fernbank - Fern Pavillion Louvers.gh (Grasshopper 0.9.76)

# ---- group: FROND 4_ALT CONFIGURATION
P = Path("{4}")
curve = Curve(<curve referenced from the Rhino model>)
outside_curve_1 = Curve(<curve referenced from the Rhino model>)
inside_curve_1 = Curve(<curve referenced from the Rhino model>)
inside_curve_2 = Curve(<curve referenced from the Rhino model>)
outside_curve_2 = Curve(<curve referenced from the Rhino model>)

# ----
louver_spacing_in = Slider(2.25, range=0..120)
offset_radius_from_ext_pipe = Slider(2.632, range=0..6)
number_slider = Slider(0, range=0..6)
louver_angle = Slider(15, range=-60..60)
cluster = Cluster_10(
    primary_rib_center_line=curve,
    outside_curve_a=outside_curve_1,
    inside_curve_b=inside_curve_1,
    inside_curve_c=inside_curve_2,
    outside_curve_d=outside_curve_2,
    path=P,
    louver_spacing_in=louver_spacing_in,
    louver_angle=louver_angle,
    offset_radius_from_ext_pipe=offset_radius_from_ext_pipe,
    extension_at_end=Slider(2, range=0..6))  # -> a_b_fastener_points_2, a_b_fastener_points_3, strut_pipes_2, strut_centerlines_2, boxes_ab_2, boxes_cd_2, louvers_ab_mitered_meshes_2, louvers_cd_mitered_meshes_2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

# ---- group: FROND 3
curve_2 = Curve(<curve referenced from the Rhino model>)
outside_curve_1_2 = Curve(<curve referenced from the Rhino model>)
inside_curve_1_2 = Curve(<curve referenced from the Rhino model>)
inside_curve_2_2 = Curve(<curve referenced from the Rhino model>)
outside_curve_2_2 = Curve(<curve referenced from the Rhino model>)
P_2 = Path("{3}")

# ----
offset_radius_from_ext_pipe_2 = Slider(2.687, range=0..6)
number_slider_2 = Slider(0, range=0..6)
louver_spacing_in_2 = Slider(2.25, range=0..120)
louver_angle_2 = Slider(35, range=-60..60)
cluster_2 = Cluster_6(
    primary_rib_center_line=curve_2,
    outside_curve_a=outside_curve_1_2,
    inside_curve_b=inside_curve_1_2,
    inside_curve_c=inside_curve_2_2,
    outside_curve_d=outside_curve_2_2,
    path=P_2,
    louver_spacing_in=louver_spacing_in_2,
    louver_angle=louver_angle_2,
    offset_radius_from_ext_pipe=offset_radius_from_ext_pipe_2,
    extension_at_end=Slider(2, range=0..6))  # -> a_b_fastener_points_2, a_b_fastener_points_3, strut_pipes_2, strut_centerlines_2, boxes_ab_2, boxes_cd_2, louvers_ab_mitered_meshes_2, louvers_cd_mitered_meshes_2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

# ---- group: FROND 2
curve_3 = Curve(<curve referenced from the Rhino model>)
outside_curve_1_3 = Curve(<curve referenced from the Rhino model>)
inside_curve_2_3 = Curve(<curve referenced from the Rhino model>)
inside_curve_1_3 = Curve(<curve referenced from the Rhino model>)
outside_curve_2_3 = Curve(<curve referenced from the Rhino model>)
P_3 = Path("{2}")

# ----
louver_spacing_in_3 = Slider(2.25, range=0..120)
louver_angle_3 = Slider(40, range=-60..60)
offset_radius_from_ext_pipe_3 = Slider(2.687, range=0..6)
number_slider_3 = Slider(0, range=0..6)
cluster_3 = Cluster_6(
    primary_rib_center_line=curve_3,
    outside_curve_a=outside_curve_1_3,
    inside_curve_b=inside_curve_1_3,
    inside_curve_c=inside_curve_2_3,
    outside_curve_d=outside_curve_2_3,
    path=P_3,
    louver_spacing_in=louver_spacing_in_3,
    louver_angle=louver_angle_3,
    offset_radius_from_ext_pipe=offset_radius_from_ext_pipe_3,
    extension_at_end=Slider(2, range=0..6))  # -> a_b_fastener_points_2, a_b_fastener_points_3, strut_pipes_2, strut_centerlines_2, boxes_ab_2, boxes_cd_2, louvers_ab_mitered_meshes_2, louvers_cd_mitered_meshes_2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

# ---- group: FROND 1
curve_4 = Curve(<curve referenced from the Rhino model>)
outside_curve_1_4 = Curve(<curve referenced from the Rhino model>)
inside_curve_1_4 = Curve(<curve referenced from the Rhino model>)
inside_curve_2_4 = Curve(<curve referenced from the Rhino model>)
P_4 = Path("{1}")
outside_curve_2_4 = Curve(<curve referenced from the Rhino model>)

# ----
louver_spacing_in_4 = Slider(2.25, range=0..120)
offset_radius_from_ext_pipe_4 = Slider(2.632, range=0..6)
number_slider_4 = Slider(0, range=0..6)
louver_angle_4 = Slider(-35, range=-60..60)
cluster_4 = Cluster_10(
    primary_rib_center_line=curve_4,
    outside_curve_a=outside_curve_1_4,
    inside_curve_b=inside_curve_1_4,
    inside_curve_c=inside_curve_2_4,
    outside_curve_d=outside_curve_2_4,
    path=P_4,
    louver_spacing_in=louver_spacing_in_4,
    louver_angle=louver_angle_4,
    offset_radius_from_ext_pipe=offset_radius_from_ext_pipe_4,
    extension_at_end=Slider(2, range=0..6))  # -> a_b_fastener_points_2, a_b_fastener_points_3, strut_pipes_2, strut_centerlines_2, boxes_ab_2, boxes_cd_2, louvers_ab_mitered_meshes_2, louvers_cd_mitered_meshes_2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

merge = Merge(Data1=cluster_4.tilt_angle_ab_2, Data2=cluster_4.check_angle_ab_2, Data3=cluster_4.miter_angle_ab_2)
merge_2 = Merge(Data1=cluster_4.tilt_angle_cd_2, Data2=cluster_4.check_angle_cd_2, Data3=cluster_4.miter_angle_cd_2)
merge_3 = Merge(Data1=cluster_3.tilt_angle_ab_2, Data2=cluster_3.check_angle_ab_2, Data3=cluster_3.miter_angle_ab_2)
merge_4 = Merge(Data1=cluster_3.tilt_angle_cd_2, Data2=cluster_3.check_angle_cd_2, Data3=cluster_3.miter_angle_cd_2)
merge_5 = Merge(Data1=cluster_2.tilt_angle_ab_2, Data2=cluster_2.check_angle_ab_2, Data3=cluster_2.miter_angle_ab_2)
merge_6 = Merge(Data1=cluster_2.tilt_angle_cd_2, Data2=cluster_2.check_angle_cd_2, Data3=cluster_2.miter_angle_cd_2)
merge_7 = Merge(Data1=cluster.tilt_angle_ab_2, Data2=cluster.check_angle_ab_2, Data3=cluster.miter_angle_ab_2)
# MITER/TILT
# ANGLES TO EXCEL
merge_8 = Merge(Data1=cluster.tilt_angle_cd_2, Data2=cluster.check_angle_cd_2, Data3=cluster.miter_angle_cd_2)

# ----
# FASTENER POINTS
# AT CENTER
# PLATE
merge_9 = Merge(
    Data1=cluster_4.a_b_fastener_points_2,
    Data2=cluster_4.a_b_fastener_points_3,
    Data3=cluster_3.a_b_fastener_points_2,
    Data4=cluster_3.a_b_fastener_points_3,
    Data5=cluster_2.a_b_fastener_points_2,
    Data6=cluster_2.a_b_fastener_points_3,
    Data7=cluster.a_b_fastener_points_2,
    Data8=cluster.a_b_fastener_points_3)
point = Point(merge_9)

# ----
# Diagonal Strut
# Pipes
merge_10 = Merge(Data1=cluster_4.strut_pipes_2, Data2=cluster_3.strut_pipes_2, Data3=cluster_2.strut_pipes_2, Data4=cluster.strut_pipes_2)
brep = Brep(merge_10)

# ----
# Diagonal Strut
# Center Lines
merge_11 = Merge(
    Data1=cluster_4.strut_centerlines_2,
    Data2=cluster_3.strut_centerlines_2,
    Data3=cluster_2.strut_centerlines_2,
    Data4=cluster.strut_centerlines_2)
line = Line(merge_11)

# ----
# Mesh Points
# 8 Points per Louver
merge_12 = Merge(
    Data1=cluster_4.mesh_pts_ab_2,
    Data2=cluster_4.mesh_pts_cd_2,
    Data3=cluster_3.mesh_pts_ab_2,
    Data4=cluster_3.mesh_pts_cd_2,
    Data5=cluster_2.mesh_pts_ab_2,
    Data6=cluster_2.mesh_pts_cd_2,
    Data7=cluster.mesh_pts_ab_2,
    Data8=cluster.mesh_pts_cd_2)
# Bake Solids
pt = Point(merge_12)

# ----
# Simple boxes
# without miters
merge_13 = Merge(
    Data1=cluster_4.boxes_ab_2,
    Data2=cluster_4.boxes_cd_2,
    Data3=cluster_3.boxes_ab_2,
    Data4=cluster_3.boxes_cd_2,
    Data5=cluster_2.boxes_ab_2,
    Data6=cluster_2.boxes_cd_2,
    Data7=cluster.boxes_ab_2,
    Data8=cluster.boxes_cd_2)
# Choose which geometry
# you want to send to Dynamo:
#    A)  the GH Louvres
#    B)  the baked Rhino Louvres
box = Box(merge_13)

# ----
# Louver meshes
# with miters
merge_14 = Merge(
    Data1=cluster_4.louvers_ab_mitered_meshes_2,
    Data2=cluster_4.louvers_cd_mitered_meshes_2,
    Data3=cluster_3.louvers_ab_mitered_meshes_2,
    Data4=cluster_3.louvers_cd_mitered_meshes_2,
    Data5=cluster_2.louvers_ab_mitered_meshes_2,
    Data6=cluster_2.louvers_cd_mitered_meshes_2,
    Data7=cluster.louvers_ab_mitered_meshes_2,
    Data8=cluster.louvers_cd_mitered_meshes_2)
mesh = Mesh(merge_14)

# ----
# Longest lengths
merge_15 = Merge(
    Data1=cluster_4.longest_length_ab_3,
    Data2=cluster_4.longest_length_ab_4,
    Data3=cluster_3.longest_length_ab_3,
    Data4=cluster_3.longest_length_ab_4,
    Data5=cluster_2.longest_length_ab_3,
    Data6=cluster_2.longest_length_ab_4,
    Data7=cluster.longest_length_ab_3,
    Data8=cluster.longest_length_ab_4)
num = Number(merge_15)

# ----
# Louver Centerlines
# without miters
merge_16 = Merge(
    Data1=cluster_4.louvres_ab_2,
    Data2=cluster_4.louvres_cd_2,
    Data3=cluster_3.louvres_ab_2,
    Data4=cluster_3.louvres_cd_2,
    Data5=cluster_2.louvres_ab_2,
    Data6=cluster_2.louvres_cd_2,
    Data7=cluster.louvres_ab_2,
    Data8=cluster.louvres_cd_2)
line_2 = Line(merge_16)

# ----
# Bake Centerlines
X = XSize(Domain(-0.75, 0.75))
X_2 = XSize(Domain(-1.75, 1.75))
num_2 = Number(1.5)
line_3 = Line(line_2)
cluster_5 = Cluster_13(louvre_width=X, louvre_depth=X_2, width_scaling_factor=num_2, typ_spacing="6", louvre_centerlines_with_gaps=line_3)
merge_17 = Merge(Data1=mesh, Data2=brep)

# ----
# Preview Meshes
swatch = ColourSwatch(SwatchColor=RGB(176, 103, 0))
preview = CustomPreview(Geometry=merge_17, Shader=swatch)

# ---- group: Transformed Louvre Centerlines (with Gaps)
line_4 = Line(line_2)

# ---- group: A) GH Louvres
box_2 = Box(box)

# ----
# Bake Meshes
mbox = MeshBox(Base=box_2, XCount=1, YCount=1, ZCount=1)
mcol = MeshColours(Mesh=mbox, Colours=swatch)

# ---- group: Louvres (UNFOLDED)
box_3 = Box(cluster_5)

# ---- group: CHANGE TO SELECT EACH 1/2 FROND
number_slider_5 = Slider(0, range=0..7)

# ---- group: SELECT A SINGLE LOUVER MESH IN PLACE
tstat = TreeStatistics(Tree=mesh)  # -> Paths, Length, Count
item = ListItem(List=tstat.Paths, Index=Slider(0, range=0..7), Wrap=True)
branch = TreeBranch(Tree=mesh, Path=item, MaintainPaths=True)
item_2 = ListItem(List=branch, Index=Slider(0, range=0..7), Wrap=True)
mesh_2 = Mesh(item_2)

# ----
mesh_3 = Mesh(mesh)
demesh = DeconstructMesh(Mesh=mesh_3)  # -> Vertices, Faces, Colours, Normals
cullpt = CullDuplicates(Points=demesh.Vertices, Tolerance=0.1, CullMode=3)  # -> Points, Indices, Valence
series = Series(Start=0, Step=1, Count=8)
int = Integer(series)
tag = TextTag(Location=cullpt.Points, Text=int, Colour=RGB(255, 255, 255))

# ----
# ID Text for
# Revit adaptive components
box_4 = Box(box_2)
viewer = ParamViewer(box_4)
viewer_2 = ParamViewer(box_4)
lng = ListLength(List=box_4)
lng_2 = ListLength(List=viewer_2)
dpath = DeconstructPath(Branch=viewer)
seq = Sequence(Count=expr("x / 2", lng_2), CharPool="ABCDEFGHIJKLMNOPQRSTUVWXYZ", Format="{0}")
item_3 = ListItem(List=dpath, Index=1, Wrap=True)
dup = DuplicateData(Data=seq, Number=2, Order=False)  # -> graft(Data)
series_2 = Series(Start=expr("x + 1", item_3), Step=2, Count=lng)
viewer_3 = ParamViewer(series_2)
viewer_4 = ParamViewer(dup)
int_2 = Integer(series_2)
path = DataPath(viewer)
txt = Text(dup)
replace = ReplacePaths(Data=int_2, Search=viewer_3, Replace=viewer)  # -> graft(Data)
replace_2 = ReplacePaths(Data=txt, Search=viewer_4, Replace=path)
dup_2 = DuplicateData(Data=replace_2, Number=lng, Order=True)
pshift = ShiftPaths(Data=dup_2, Offset=-1)  # -> graft(Data)
merge_18 = Merge(Data1=replace, Data2=pshift)
panel = Panel("-")
join = TextJoin(Text=merge_18)
pshift_2 = ShiftPaths(Data=join, Offset=-1)  # -> graft(Data)

# ----
# Select Louvers
tstat_2 = TreeStatistics(Tree=box)  # -> Paths, Length, Count
item_4 = ListItem(List=tstat_2.Paths, Index=number_slider_5, Wrap=True)
branch_2 = TreeBranch(Tree=box, Path=item_4, MaintainPaths=True)
branch_3 = TreeBranch(Tree=mesh, Path=item_4, MaintainPaths=True)
dpath_2 = DeconstructPath(Branch=item_4)
item_5 = ListItem(List=dpath_2, Index=0, Wrap=True)  # -> Item, Item1
expression = Expression(x=item_5.Item, y=item_5.Item1, Expression="Format(\"{{{0};{1};*}}\", x, y)")
split = SplitTree(Data=pt, Masks=flatten(expression))  # -> Positive, Negative

# ----
# Longest Lengths
num_3 = Number(num)

list = ValueList({"Feet": 0, "Inches": 1, "Meters": 2, "Millimeters": 3}, selected="Feet")
arch = ARCH(decimal_inputs=num_3, units=list, fraction_denominator="8")
division = Division(A=num_3, B="12")
panel_2 = Panel(num_3)

# ----
# Placement Points for
# Revit adaptive components
panel_3 = Panel("1 / 12")
scale = Scale(Geometry=pt, Center=Point(0, 0, 0), Factor=panel_3)  # -> Geometry, Transform
pdecon = Deconstruct(Point=graft(scale.Geometry))  # -> XComponent, YComponent, ZComponent
merge_19 = Merge(Data1=pdecon.XComponent, Data2=pdecon.YComponent, Data3=pdecon.ZComponent)
pshift_3 = ShiftPaths(Data=merge_19, Offset=-1)

panel_4 = Panel(arch)
panel_5 = Panel(division)
num_4 = Number(graft(division))
txt_2 = Text(arch)
# P:\Atlanta\801345.000_Fernbank_Nature_Preserve\DESIGN\STUDY\TEAM\Jared\2015-08-10 Rhino Base Models\FERN (single sheet).xlsx
panel_6 = Panel(num_4)

# ---- group: Selected Louvers (Mesh Points)
pt_2 = Point(split.Positive)

# ---- group: Selected Louvers (box)
box_5 = Box(branch_2)

# ---- group: Selected Louvers (mesh)
mesh_4 = Mesh(branch_3)

# ----
shift_paths = ShiftPaths(Data=pshift_2, Offset=-1)

# ----
# Get Louver Plane
debox = DeconstructBox(Box=box_5)  # -> Plane, X, Y, Z
deplane = DeconstructPlane(Plane=debox.Plane)  # -> Origin, XAxis, YAxis, ZAxis
rev = Reverse(Vector=deplane.YAxis)
rev_2 = Reverse(Vector=deplane.ZAxis)
pl = ConstructPlane(Origin=deplane.Origin, XAxis=rev_2, YAxis=rev)

panel_7 = Panel(pshift_2)

# ---- group: Louver Plane
pln = Plane(pl)

# ----
pln_2 = Plane(graft(pln))
xy = XYPlane(Origin=Point(0, 0, 0))
orient = Orient(Geometry=pt_2, Source=pln_2, Target=xy)  # -> Geometry, Transform
orient_2 = Orient(Geometry=mesh_4, Source=pln, Target=xy)  # -> Geometry, Transform

# ----
# Select a single Louver
tstat_3 = TreeStatistics(Tree=orient.Geometry)  # -> Paths, Length, Count
number_slider_6 = Slider(4, range=0..64)
item_6 = ListItem(List=tstat_3.Paths, Index=number_slider_6, Wrap=True)
item_7 = ListItem(List=orient_2.Geometry, Index=number_slider_6, Wrap=True)
branch_4 = TreeBranch(Tree=orient.Geometry, Path=item_6, MaintainPaths=True)

# ---- group: Louver Mesh
mesh_5 = Mesh(item_7)

# ----
preview_2 = CustomPreview(Geometry=mesh_5, Shader=ColourSwatch(SwatchColor=RGB(138, 140, 255)))

# ---- group: Mesh Points
pt_3 = Point(branch_4)

# ----
item_8 = ListItem(List=pt_3, Index=Slider(2, range=0..7), Wrap=True)
item_9 = ListItem(List=pt_3, Index=0, Wrap=True)  # -> Item, Item1, Item2, Item3, Item4, Item5, Item6, Item7
sph = Sphere(Base=item_8, Radius=0.5)

# ---- group: Pt. B
pt_4 = Point(item_9.Item1)

# ---- group: Pt. C
pt_5 = Point(item_9.Item2)

# ---- group: Pt. D
pt_6 = Point(item_9.Item3)

# ---- group: Pt. F
pt_7 = Point(item_9.Item5)

# ---- group: Pt. H
pt_8 = Point(item_9.Item7)

# ---- group: Pt. G
pt_9 = Point(item_9.Item6)

# ----
pl_3pt = Plane3Pt(PointA=pt_5, PointB=pt_9, PointC=pt_8)
ln = Line(StartPoint=pt_4, EndPoint=pt_5)
ln_2 = Line(StartPoint=pt_5, EndPoint=pt_6)
vec2pt = Vector2Pt(PointA=pt_4, PointB=pt_7, Unitize=False)  # -> Vector, Length
ln_3 = Line(StartPoint=pt_7, EndPoint=pt_9)
check_line = Line(StartPoint=pt_9, EndPoint=pt_8)

# ---- group: Plane C-G-H
# Check Plane
pln_3 = Plane(pl_3pt)

# ---- group: Line G-H
# Check Edge
line_5 = Line(check_line)

# ---- group: Line C-D
# Z-Axis
line_6 = Line(ln_2)

# ---- group: Vector B-F
# X-Axis
vec = Vector(vec2pt.Vector)

# ---- group: Line F-G
# Miter Edge
line_7 = Line(ln_3)

# ---- group: Line B-C
# Y-Axis
line_8 = Line(ln)

# ---- group: Moved Line B-C
# Move Line B-C (Y-Axis)
# From Pt. B to Pt. F
# "Miter Edge 90 Deg Ref"
move = Move(Geometry=line_8, Motion=vec)  # -> Geometry, Transform
line_9 = Line(move.Geometry)

# ----
# Get Tilt Plane
panel_8 = Panel("3")
cluster_6 = Cluster_14(L=line_7, extension=panel_8)
pframe = PerpFrame(Curve=cluster_6, Parameter=1)

# ---- group: Line C-D
# Z-Axis
line_10 = Line(line_6)

# ----
X_3 = UnitX(Factor=1)
align = AlignPlane(Plane=pframe, Direction=X_3)  # -> Plane, Angle

# ---- group: Line G-H
# Check Edge
line_11 = Line(line_5)

# ---- group: Perpendicular to Miter Edge
# Tilt Plane
pln_4 = Plane(align.Plane)

# ---- group: Line G'-H'
# Check Edge
# Projected on to
# Tilt Plane
project = Project(Geometry=line_11, Plane=pln_4)  # -> Geometry, Transform
line_12 = Line(project.Geometry)

# ----
end = EndPoints(Curve=line_12)  # -> Start, End

# ---- group: Line C-D
# Z-Axis
line_13 = Line(line_10)

# Z-Axis
line_14 = Line(line_10)

# ----
end_2 = EndPoints(Curve=line_13)  # -> Start, End

# ---- group: Pt. G'
pt_10 = Point(end.Start)

# ---- group: Pt. G
pt_11 = Point(pt_9)

# ----
end_3 = EndPoints(Curve=line_14)  # -> Start, End
vec2pt_2 = Vector2Pt(PointA=end_2.Start, PointB=pt_10, Unitize=False)  # -> Vector, Length
vec2pt_3 = Vector2Pt(PointA=end_3.Start, PointB=pt_11, Unitize=False)  # -> Vector, Length
move_2 = Move(Geometry=line_13, Motion=vec2pt_2.Vector)  # -> Geometry, Transform
move_3 = Move(Geometry=line_14, Motion=vec2pt_3.Vector)  # -> Geometry, Transform

# ---- group: Moved Line B-C
# Move Line B-C (Y-Axis)
# From Pt. B to Pt. F
# "Miter Edge 90 Deg Ref"
line_15 = Line(line_9)

# ---- group: Line F-G
# Miter Edge
line_16 = Line(line_7)

# ---- group: Line G'-H'
# Check Edge
# Projected on to
# Tilt Plane
line_17 = Line(line_12)

# ---- group: Line C'-D'
# Z-Axis
# Moved to G'
# (Tilt Plane)
line_18 = Line(move_2.Geometry)

# ---- group: Line G-H
# Check Edge
line_19 = Line(line_5)

# ---- group: Line C''-D''
# Z-Axis
# Moved to G
line_20 = Line(move_3.Geometry)

# ----
end_4 = EndPoints(Curve=line_17)  # -> Start, End
end_5 = EndPoints(Curve=line_19)  # -> Start, End

# ---- group: Pt. H'
pt_12 = Point(end_4.End)

# ---- group: Pt. H
pt_13 = Point(end_5.End)

# ----
panel_9 = Panel("""P:\Atlanta\801345.000_Fernbank_Nature_Preserve\DESIGN\STUDY\TEAM\Jared\2016-02-25 Fern Model to VW\Flat Louver Angles_Excel\Louver Angles F1_A-B.xlsx
P:\Atlanta\801345.000_Fernbank_Nature_Preserve\DESIGN\STUDY\TEAM\Jared\2016-02-25 Fern Model to VW\Flat Louver Angles_Excel\Louver Angles F1_C-D.xlsx
P:\Atlanta\801345.000_Fernbank_Nature_Preserve\DESIGN\STUDY\TEAM\Jared\2016-02-25 Fern Model to VW\Flat Louver Angles_Excel\Louver Angles F2_A-B.xlsx
P:\Atlanta\801345.000_Fernbank_Nature_Preserve\DESIGN\STUDY\TEAM\Jared\2016-02-25 Fern Model to VW\Flat Louver Angles_Excel\Louver Angles F2_C-D.xlsx
P:\Atlanta\801345.000_Fernbank_Nature_Preserve\DESIGN\STUDY\TEAM\Jared\2016-02-25 Fern Model to VW\Flat Louver Angles_Excel\Louver Angles F3_A-B.xlsx
P:\Atlanta\801345.000_Fernbank_Nature_Preserve\DESIGN\STUDY\TEAM\Jared\2016-02-25 Fern Model to VW\Flat Louver Angles_Excel\Louver Angles F3_C-D.xlsx
P:\Atlanta\801345.000_Fernbank_Nature_Preserve\DESIGN\STUDY\TEAM\Jared\2016-02-25 Fern Model to VW\Flat Louver Angles_Excel\Louver Angles F4_A-B.xlsx
P:\Atlanta\801345.000_Fernbank_Nature_Preserve\DESIGN\STUDY\TEAM\Jared\2016-02-25 Fern Model to VW\Flat Louver Angles_Excel\Louver Angles F4_C-D.xlsx""")

# ---- group: MITER ANGLE
cluster_7 = Cluster_14(L=line_15, extension="3")
cluster_8 = Cluster_14(L=line_16, extension="3")
end_6 = EndPoints(Curve=cluster_7)  # -> Start, End
end_7 = EndPoints(Curve=cluster_8)  # -> Start, End
angledim = AngularDimension(Center=end_6.Start, PointA=end_6.End, PointB=end_7.End, Reflex=False, Text="{0:0.0}°", Size=0.75)

# ---- group: TILT ANGLE
cluster_9 = Cluster_14(L=line_17, extension="3")
cluster_10 = Cluster_14(L=line_18, extension="3")
end_8 = EndPoints(Curve=cluster_9)  # -> Start, End
end_9 = EndPoints(Curve=cluster_10)  # -> Start, End
angledim_2 = AngularDimension(Center=end_8.Start, PointA=end_8.End, PointB=end_9.End, Reflex=False, Text="{0:0.0}°", Size=0.75)

# ---- group: CHECK ANGLE
cluster_11 = Cluster_14(L=line_19, extension="3")
cluster_12 = Cluster_14(L=line_20, extension="3")
end_10 = EndPoints(Curve=cluster_11)  # -> Start, End
end_11 = EndPoints(Curve=cluster_12)  # -> Start, End
angledim_3 = AngularDimension(Center=end_10.Start, PointA=end_10.End, PointB=end_11.End, Reflex=False, Text="{0:0.0}°", Size=0.75)

# ---- group: Perpendicular to Miter Edge
# Tilt Plane
pln_5 = Plane(pln_4)

# ---- group: Plane C-G-H
# Check Plane
pln_6 = Plane(pln_3)

# ---- group: Line C'-D'
# Z-Axis
# Moved to G'
# (Tilt Plane)
line_21 = Line(line_18)

# ---- group: Line C''-D''
# Z-Axis
# Moved to G
line_22 = Line(line_20)

# ----
xy_2 = XYPlane(Origin=Point(0, 0, 0))

# ---- group: Pt. G
pt_14 = Point(pt_9)

# ----
side = CurveSide(Curve=line_15, Point=pt_14, Plane=xy_2)  # -> Side, Left, Right
angle = Angle(VectorA=cluster_7, VectorB=cluster_8)  # -> Angle, Reflex
side_2 = CurveSide(Curve=line_21, Point=pt_12, Plane=pln_5)  # -> Side, Left, Right
angle_2 = Angle(VectorA=cluster_9, VectorB=cluster_10)  # -> Angle, Reflex
side_3 = CurveSide(Curve=line_22, Point=pt_13, Plane=pln_6)  # -> Side, Left, Right
angle_3 = Angle(VectorA=cluster_11, VectorB=cluster_12)  # -> Angle, Reflex
neg = Negative(Value=side_2.Side)
neg_2 = Negative(Value=side_3.Side)
panel_10 = Panel(side.Side)
panel_11 = Panel(neg_2)
panel_12 = Panel(neg)
multiplication = Multiplication(A=panel_10, B=angle.Angle)
multiplication_2 = Multiplication(A=panel_12, B=angle_2.Angle)
multiplication_3 = Multiplication(A=panel_11, B=angle_3.Angle)
deg = Degrees(Radians=multiplication)
deg_2 = Degrees(Radians=multiplication_2)
deg_3 = Degrees(Radians=multiplication_3)
item_10 = ListItem(List=panel_9, Index=number_slider_5, Wrap=True)
merge_20 = Merge(Data1=deg, Data2=deg_2, Data3=deg_3)
panel_13 = Panel(deg)
panel_14 = Panel(deg_2)
panel_15 = Panel(deg_3)

# ----
# Placement Points for
# Revit adaptive components
# Unfolded
edges = BrepEdges(Brep=box_3)  # -> Naked, Interior, NonManifold
panel_16 = Panel("""1
5
7
3""")
item_11 = ListItem(List=edges.Interior, Index=panel_16, Wrap=True)
eval = EvaluateCurve(Curve=reparameterize(item_11), Parameter=0.5)  # -> Point, Tangent, Angle
pline = PolyLine(Vertices=eval.Point, Closed=False)

panel_17 = Panel(edges.Interior)
scale_2 = Scale(Geometry=eval.Point, Center=Point(0, 0, 0), Factor="1 / 12")  # -> Geometry, Transform

pdecon_2 = Deconstruct(Point=graft(scale_2.Geometry))  # -> XComponent, YComponent, ZComponent
merge_21 = Merge(Data1=pdecon_2.XComponent, Data2=pdecon_2.YComponent, Data3=pdecon_2.ZComponent)
pshift_4 = ShiftPaths(Data=merge_21, Offset=-1)

panel_18 = Panel(scale_2.Geometry)

# ==== cluster Cluster_6
outside_curve_a = ClusterInput()
inside_curve_b = ClusterInput()
inside_curve_c = ClusterInput()
outside_curve_d = ClusterInput()
path = ClusterInput()
louver_spacing_in = ClusterInput()
louver_angle = ClusterInput()
extension_at_end = ClusterInput()
primary_rib_center_line = ClusterInput()
offset_radius_from_ext_pipe = ClusterInput()
primary_rib_center_line_2 = Curve(primary_rib_center_line)
path_2 = DataPath(path)
outside_curve_a_2 = Curve(outside_curve_a)
inside_curve_b_2 = Curve(inside_curve_b)
inside_curve_c_2 = Curve(inside_curve_c)
outside_curve_d_2 = Curve(outside_curve_d)
louver_spacing_in_2 = Number(louver_spacing_in)
louver_angle_2 = Number(louver_angle)
extension_at_end_2 = Number(extension_at_end)
offset_radius_from_ext_pipe_2 = Number(offset_radius_from_ext_pipe)
merge = Merge(Data1=outside_curve_a_2, Data2=inside_curve_b_2, Data3=inside_curve_c_2, Data4=outside_curve_d_2)

# ----
# Uniform V-Curves
# The NURBS curves captured from Rhino are intended to have the same orientation (i.e. run from top-to-bottom).
# By comparing the Z value at either end of each curve, we can determine which V-Curves need to be flipped.
rib_crv = Curve(graft(merge))
end = EndPoints(Curve=rib_crv)  # -> Start, End
pdecon = Deconstruct(Point=end.Start)  # -> XComponent, YComponent, ZComponent
pdecon_2 = Deconstruct(Point=end.End)  # -> XComponent, YComponent, ZComponent
larger = LargerThan(FirstNumber=pdecon.ZComponent, SecondNumber=pdecon_2.ZComponent)  # -> LargerThan, OrEqualTo
flip = FlipCurve(Curve=rib_crv)  # -> Curve, Flag
not = GateNot(A=larger.LargerThan)
merge_2 = Merge(Data1=larger.LargerThan, Data2=not)
merge_3 = Merge(Data1=rib_crv, Data2=flip.Curve)
cull = CullPattern(List=merge_3, CullPattern=merge_2)
rib_crv_2 = Curve(cull)

bang = ExplodeTree(Data=rib_crv_2)  # -> flatten(Branch0), flatten(Branch1), flatten(Branch2), flatten(Branch3)

# ---- group: Outside Curve A
crv = Curve(bang.Branch0)

# ---- group: Inside Curve B
crv_2 = Curve(bang.Branch1)

# ---- group: Inside Curve C
crv_3 = Curve(bang.Branch2)

# ---- group: Outside Curve D
crv_4 = Curve(bang.Branch3)

# ---- group: Louver Spacing (in)
num = Number(louver_spacing_in_2)

# ---- group: Louver Angle
num_2 = Number(louver_angle_2)

# ----
len = Length(Curve=crv_2)
division = Division(A=len, B=num)
pframes = PerpFrames(Curve=crv_2, Count=expr("floor(x)", division), Align=True)  # -> flatten(Frames), Parameters
rot3d = Rotate3D(Geometry=pframes.Frames, Angle=degrees(num_2), Center=pframes.Frames, Axis=Vector(0, 0, 1))  # -> Geometry, Transform

panel = Panel("""TRUE
FALSE""")
inverse_transform = InverseTransform(Transform=rot3d.Transform)
panel_2 = Panel("""FALSE
TRUE""")
cull_2 = CullPattern(List=rot3d.Geometry, CullPattern=panel)
cull_3 = CullPattern(List=rot3d.Geometry, CullPattern=panel_2)
pcx = CurvePlane(Curve=crv, Plane=cull_2)  # -> flatten(Points), ParamsC, ParamsP

crv_5 = Curve(crv_3)
crv_cp = CurveClosestPoint(Point=cull_3, Curve=crv_5)  # -> flatten(Point), Parameter, Distance
pframe = PerpFrame(Curve=crv_5, Parameter=crv_cp.Parameter)
Y = UnitY(Factor=1)
neg = Negative(Value=louver_angle_2)
rot3d_2 = Rotate3D(Geometry=pframe, Angle=degrees(neg), Center=pframe, Axis=Y)  # -> Geometry, Transform
pcx_2 = CurvePlane(Curve=crv_4, Plane=rot3d_2.Geometry)  # -> flatten(Points), ParamsC, ParamsP
pl_origin = PlaneOrigin(Base=rot3d_2.Geometry, Origin=pcx_2.Points)

deconstruct_plane = DeconstructPlane(Plane=cull_2)  # -> Origin, XAxis, YAxis, ZAxis
pl_origin_2 = PlaneOrigin(Base=cull_2, Origin=pcx.Points)
pcx_3 = CurvePlane(Curve=primary_rib_center_line_2, Plane=cull_3)  # -> flatten(Points), ParamsC, ParamsP
pcx_4 = CurvePlane(Curve=primary_rib_center_line_2, Plane=cull_2)  # -> flatten(Points), ParamsC, ParamsP
cluster = Cluster_5(
    center_pipe_curve=primary_rib_center_line_2,
    outside_curve_a=outside_curve_a_2,
    a_planes=pl_origin_2,
    outside_curve_d=outside_curve_d_2,
    d_planes=pl_origin)  # -> diagonal_struts_2, strut_center_lines_2
num_3 = Number(offset_radius_from_ext_pipe_2)

# ---- group: Center of Pod
pt = Point(<point referenced from the Rhino model>)

# ----
num_4 = Number(extension_at_end_2)

# ---- group: Inside Curve B
crv_6 = Curve(crv_2)

# ---- group: Inside Curve C
crv_7 = Curve(crv_3)

# ----
path_3 = DataPath(path_2)

# ---- group: DETERIMINE TANGENT OFFSET FROM PIPE
louver_spacing_in_3 = Number(1.4375)
pipe = Pipe(Curve=outside_curve_d_2, Radius=louver_spacing_in_3, Caps=0)
brep_plane = BrepPlane(Brep=pipe, Plane=pl_origin)  # -> Curves, Points
area = Area(Geometry=brep_plane.Curves)  # -> Area, Centroid
louver_spacing_in_4 = Number(1.375)

# ----
curve_closest_point = CurveClosestPoint(Point=area.Centroid, Curve=brep_plane.Curves)  # -> Point, Parameter, Distance

# ---- group: DETERIMINE TANGENT OFFSET FROM PIPE (continued)
addition = Addition(A=curve_closest_point.Distance, B=louver_spacing_in_4)  # -> flatten(Result)

# ----
panel_3 = Panel(addition)

# ---- group: DETERIMINE TANGENT OFFSET FROM PIPE
louver_spacing_in_5 = Number(1.4375)
pipe_2 = Pipe(Curve=outside_curve_a_2, Radius=louver_spacing_in_5, Caps=0)
brep_plane_2 = BrepPlane(Brep=pipe_2, Plane=pl_origin_2)  # -> Curves, Points
area_2 = Area(Geometry=brep_plane_2.Curves)  # -> Area, Centroid
louver_spacing_in_6 = Number(1.375)

# ----
curve_closest_point_2 = CurveClosestPoint(Point=area_2.Centroid, Curve=brep_plane_2.Curves)  # -> Point, Parameter, Distance

# ---- group: DETERIMINE TANGENT OFFSET FROM PIPE (continued)
addition_2 = Addition(A=curve_closest_point_2.Distance, B=louver_spacing_in_6)  # -> flatten(Result)

# ----
cir = Circle(Plane=pl_origin_2, Radius=addition_2)
cir_2 = Circle(Plane=pl_origin, Radius=addition)
short = ShortestList(ListA=cir, ListB=deconstruct_plane.Origin, TrimMode=1)  # -> ListA, ListB
short_2 = ShortestList(ListA=crv_cp.Point, ListB=cir_2, TrimMode=1)  # -> ListA, ListB
tan = TangentLines(Point=short.ListB, Circle=short.ListA)  # -> Tangent1, Tangent2
tan_2 = TangentLines(Point=short_2.ListA, Circle=short_2.ListB)  # -> Tangent1, Tangent2

curve = Curve(tan.Tangent2)
curve_2 = Curve(tan_2.Tangent1)
curve_3 = Curve(tan_2.Tangent2)
curve_4 = Curve(tan.Tangent1)

# ----
# Uniform Tangent Curves
# The resulting tangent lines are intended to consistently be
# the ones tangent at inside face of ribs.
# By comparing the distance from center of pod
# to either end of each tangent line,
# we can determine which lines need to be flipped.
cluster_2 = Cluster(t1=tan.Tangent1, t2=tan.Tangent2, center_of_pod=pt)  # disabled
cluster_3 = Cluster(t1=tan_2.Tangent1, t2=tan_2.Tangent2, center_of_pod=pt)  # disabled

preview = CustomPreview(Geometry=cluster_2, Shader=ColourSwatch(SwatchColor=RGB(255, 255, 255)))

ext = ExtendCurve(Curve=curve_4, Type=0, Start=0, End=num_4)
ext_2 = ExtendCurve(Curve=curve_3, Type=0, Start=0, End=num_4)
end_2 = EndPoints(Curve=ext)  # -> Start, End
end_3 = EndPoints(Curve=ext_2)  # -> Start, End
ln = Line(StartPoint=end_2.Start, EndPoint=end_2.End)
ln_2 = Line(StartPoint=end_3.Start, EndPoint=end_3.End)

# ---- group: Lines AB (before miter)
line = Line(ln)

# ---- group: Lines CD (before miter)
line_2 = Line(ln_2)

# ----
# Compound Miters
# First the louver boxes are generated
# (this step used to be outside the cluster)
# 
# The long edges of the louver boxes are intersected with
# the plane of the vertical inside rib curves.
# These intersection points are used to re-construct 6-sided meshes
# which represent the louvres with a compound miter.
# 
# The reason for using meshes is to avoid the performance of
# the Grasshopper algorithm to be slowed down (versus using NURBS soldis)
cluster_4 = Cluster_3(line=line)
cluster_5 = Cluster_3(line=line_2)
cluster_6 = Cluster_2(box_before_miters=cluster_4, inside_curve=crv_6)  # -> tilt_angle_3, check_angle_2, tilt_angle, louver_meshes_with_miters_2, mesh_pts_2, longest_length_2, fastener_points_2
cluster_7 = Cluster_2(box_before_miters=cluster_5, inside_curve=crv_7)  # -> tilt_angle_3, check_angle_2, tilt_angle, louver_meshes_with_miters_2, mesh_pts_2, longest_length_2, fastener_points_2

cluster_8 = Cluster_4(assigned_path=path_3, data=cluster_6.mesh_pts_2)
cluster_9 = Cluster_4(assigned_path=path_3, data=cluster_7.mesh_pts_2)
flatten = FlattenTree(Tree=cluster_6.longest_length_2, Path=path_3)
flatten_2 = FlattenTree(Tree=cluster_7.longest_length_2, Path=path_3)
pt_2 = Point(cluster_8)
path_mapper = PathMapper(flatten, source="{A}", target="{A;0}")
path_mapper_2 = PathMapper(flatten_2, source="{A}", target="{A;1}")
path_mapper_3 = PathMapper(pt_2, source="{A;B}", target="{A;0;B}")
longest_length_ab = Number(path_mapper)
longest_length_ab_2 = Number(path_mapper_2)
mesh_pts_ab = Point(path_mapper_3)
tilt_angle_ab = Number(cluster_6.tilt_angle_3)
tilt_angle_cd = Number(cluster_7.tilt_angle_3)

clean = CleanTree(Tree=line, CleanInvalid=True, CleanEmpty=False)
clean_2 = CleanTree(Tree=line_2, CleanInvalid=True, CleanEmpty=False)
flatten_3 = FlattenTree(Tree=cluster_4, Path=path_3)
flatten_4 = FlattenTree(Tree=cluster_5, Path=path_3)
flatten_5 = FlattenTree(Tree=cluster_6.louver_meshes_with_miters_2, Path=path_3)
flatten_6 = FlattenTree(Tree=cluster_7.louver_meshes_with_miters_2, Path=path_3)
flatten_7 = FlattenTree(Tree=clean, Path=path_3)
flatten_8 = FlattenTree(Tree=clean_2, Path=path_3)
pt_3 = Point(cluster_9)
path_mapper_4 = PathMapper(flatten_3, source="{A}", target="{A;0}")
path_mapper_5 = PathMapper(flatten_4, source="{A}", target="{A;1}")
path_mapper_6 = PathMapper(flatten_5, source="{A}", target="{A;0}")
path_mapper_7 = PathMapper(flatten_6, source="{A}", target="{A;1}")
path_mapper_8 = PathMapper(flatten_7, source="{A}", target="{A;0}")
path_mapper_9 = PathMapper(flatten_8, source="{A}", target="{A;1}")
path_mapper_10 = PathMapper(pt_3, source="{A;B}", target="{A;1;B}")
c_d_fastener_points = Point(cluster_7.fastener_points_2)
strut_pipes = Brep(cluster.diagonal_struts_2)
a_b_fastener_points = Point(cluster_6.fastener_points_2)
strut_centerlines = Curve(cluster.strut_center_lines_2)
boxes_ab = Box(path_mapper_4)
boxes_cd = Box(path_mapper_5)
louvers_ab_mitered_meshes = Mesh(path_mapper_6)
louvers_cd_mitered_meshes = Mesh(path_mapper_7)
louvres_cd = Line(path_mapper_9)
mesh_pts_cd = Point(path_mapper_10)
louvres_ab = Line(path_mapper_8)
check_angle_ab = Number(cluster_6.check_angle_2)
miter_angle_ab = Number(cluster_6.tilt_angle)
check_angle_cd = Number(cluster_7.check_angle_2)
miter_angle_cd = Number(cluster_7.tilt_angle)
strut_centerlines_2 = ClusterOutput(strut_centerlines)
strut_pipes_2 = ClusterOutput(strut_pipes)
a_b_fastener_points_2 = ClusterOutput(a_b_fastener_points)
a_b_fastener_points_3 = ClusterOutput(c_d_fastener_points)
tilt_angle_ab_2 = ClusterOutput(tilt_angle_ab)
check_angle_ab_2 = ClusterOutput(check_angle_ab)
miter_angle_ab_2 = ClusterOutput(miter_angle_ab)
tilt_angle_cd_2 = ClusterOutput(tilt_angle_cd)
check_angle_cd_2 = ClusterOutput(check_angle_cd)
miter_angle_cd_2 = ClusterOutput(miter_angle_cd)

boxes_ab_2 = ClusterOutput(boxes_ab)
boxes_cd_2 = ClusterOutput(boxes_cd)
louvers_ab_mitered_meshes_2 = ClusterOutput(louvers_ab_mitered_meshes)
louvers_cd_mitered_meshes_2 = ClusterOutput(louvers_cd_mitered_meshes)
mesh_pts_ab_2 = ClusterOutput(mesh_pts_ab)
mesh_pts_cd_2 = ClusterOutput(mesh_pts_cd)
longest_length_ab_3 = ClusterOutput(longest_length_ab)
longest_length_ab_4 = ClusterOutput(longest_length_ab_2)
louvres_ab_2 = ClusterOutput(louvres_ab)
louvres_cd_2 = ClusterOutput(louvres_cd)

# ==== cluster Cluster_10
outside_curve_a = ClusterInput()
inside_curve_b = ClusterInput()
inside_curve_c = ClusterInput()
outside_curve_d = ClusterInput()
path = ClusterInput()
louver_spacing_in = ClusterInput()
louver_angle = ClusterInput()
extension_at_end = ClusterInput()
primary_rib_center_line = ClusterInput()
offset_radius_from_ext_pipe = ClusterInput()
primary_rib_center_line_2 = Curve(primary_rib_center_line)
path_2 = DataPath(path)
outside_curve_a_2 = Curve(outside_curve_a)
inside_curve_b_2 = Curve(inside_curve_b)
inside_curve_c_2 = Curve(inside_curve_c)
outside_curve_d_2 = Curve(outside_curve_d)
louver_spacing_in_2 = Number(louver_spacing_in)
louver_angle_2 = Number(louver_angle)
extension_at_end_2 = Number(extension_at_end)
offset_radius_from_ext_pipe_2 = Number(offset_radius_from_ext_pipe)
merge = Merge(Data1=outside_curve_a_2, Data2=inside_curve_b_2, Data3=inside_curve_c_2, Data4=outside_curve_d_2)

# ----
# Uniform V-Curves
rib_crv = Curve(graft(merge))
end = EndPoints(Curve=rib_crv)  # -> Start, End
pdecon = Deconstruct(Point=end.Start)  # -> XComponent, YComponent, ZComponent
pdecon_2 = Deconstruct(Point=end.End)  # -> XComponent, YComponent, ZComponent
larger = LargerThan(FirstNumber=pdecon.ZComponent, SecondNumber=pdecon_2.ZComponent)  # -> LargerThan, OrEqualTo
flip = FlipCurve(Curve=rib_crv)  # -> Curve, Flag
not = GateNot(A=larger.LargerThan)
merge_2 = Merge(Data1=larger.LargerThan, Data2=not)
merge_3 = Merge(Data1=rib_crv, Data2=flip.Curve)
cull = CullPattern(List=merge_3, CullPattern=merge_2)
rib_crv_2 = Curve(cull)

bang = ExplodeTree(Data=rib_crv_2)  # -> flatten(Branch0), flatten(Branch1), flatten(Branch2), flatten(Branch3)

# ---- group: Outside Curve A
crv = Curve(bang.Branch0)

# ---- group: Inside Curve B
crv_2 = Curve(bang.Branch1)

# ---- group: Inside Curve C
crv_3 = Curve(bang.Branch2)

# ---- group: Outside Curve D
crv_4 = Curve(bang.Branch3)

# ---- group: Louver Spacing (in)
num = Number(louver_spacing_in_2)

# ---- group: Louver Angle
num_2 = Number(louver_angle_2)

# ----
len = Length(Curve=crv_2)
division = Division(A=len, B=num)
pframes = PerpFrames(Curve=crv_2, Count=expr("floor(x)", division), Align=True)  # -> flatten(Frames), Parameters
rot3d = Rotate3D(Geometry=pframes.Frames, Angle=degrees(num_2), Center=pframes.Frames, Axis=Vector(0, 0, 1))  # -> Geometry, Transform

panel = Panel("""TRUE
FALSE""")
inverse_transform = InverseTransform(Transform=rot3d.Transform)
panel_2 = Panel("""FALSE
TRUE""")
cull_2 = CullPattern(List=rot3d.Geometry, CullPattern=panel)
cull_3 = CullPattern(List=rot3d.Geometry, CullPattern=panel_2)
pcx = CurvePlane(Curve=crv, Plane=cull_2)  # -> flatten(Points), ParamsC, ParamsP

crv_5 = Curve(crv_3)
crv_cp = CurveClosestPoint(Point=cull_3, Curve=crv_5)  # -> flatten(Point), Parameter, Distance
pframe = PerpFrame(Curve=crv_5, Parameter=crv_cp.Parameter)
Y = UnitY(Factor=1)
neg = Negative(Value=louver_angle_2)
rot3d_2 = Rotate3D(Geometry=pframe, Angle=degrees(neg), Center=pframe, Axis=Y)  # -> Geometry, Transform
pcx_2 = CurvePlane(Curve=crv_4, Plane=rot3d_2.Geometry)  # -> flatten(Points), ParamsC, ParamsP
pl_origin = PlaneOrigin(Base=rot3d_2.Geometry, Origin=pcx_2.Points)

deconstruct_plane = DeconstructPlane(Plane=cull_2)  # -> Origin, XAxis, YAxis, ZAxis
pl_origin_2 = PlaneOrigin(Base=cull_2, Origin=pcx.Points)
pcx_3 = CurvePlane(Curve=primary_rib_center_line_2, Plane=cull_3)  # -> flatten(Points), ParamsC, ParamsP
pcx_4 = CurvePlane(Curve=primary_rib_center_line_2, Plane=cull_2)  # -> flatten(Points), ParamsC, ParamsP
num_3 = Number(offset_radius_from_ext_pipe_2)

# ---- group: Center of Pod
pt = Point(<point referenced from the Rhino model>)

# ----
outside_curve_d_3 = Curve(outside_curve_d)
primary_rib_center_line_3 = Curve(primary_rib_center_line)
outside_curve_a_3 = Curve(outside_curve_a)
num_4 = Number(extension_at_end_2)
cluster = Cluster_9(
    center_pipe_curve=primary_rib_center_line_3,
    outside_curve_a=outside_curve_a_3,
    a_planes=pl_origin_2,
    outside_curve_d=outside_curve_d_3,
    d_planes=pl_origin)  # -> diagonal_struts_2, strut_center_lines_2

# ---- group: Inside Curve B
crv_6 = Curve(crv_2)

# ---- group: Inside Curve C
crv_7 = Curve(crv_3)

# ----
path_3 = DataPath(path_2)
strut_pipes = Brep(cluster.diagonal_struts_2)
strut_centerlines = Curve(cluster.strut_center_lines_2)
strut_centerlines_2 = ClusterOutput(strut_centerlines)
strut_pipes_2 = ClusterOutput(strut_pipes)

# ---- group: DETERIMINE TANGENT OFFSET FROM PIPE
louver_spacing_in_3 = Number(1.4375)
pipe = Pipe(Curve=outside_curve_d_2, Radius=louver_spacing_in_3, Caps=0)
brep_plane = BrepPlane(Brep=pipe, Plane=pl_origin)  # -> Curves, Points
area = Area(Geometry=brep_plane.Curves)  # -> Area, Centroid
louver_spacing_in_4 = Number(1.375)

# ----
curve_closest_point = CurveClosestPoint(Point=area.Centroid, Curve=brep_plane.Curves)  # -> Point, Parameter, Distance

# ---- group: DETERIMINE TANGENT OFFSET FROM PIPE (continued)
addition = Addition(A=curve_closest_point.Distance, B=louver_spacing_in_4)  # -> flatten(Result)

# ----
panel_3 = Panel(addition)

# ---- group: DETERIMINE TANGENT OFFSET FROM PIPE
louver_spacing_in_5 = Number(1.4375)
pipe_2 = Pipe(Curve=outside_curve_a_2, Radius=louver_spacing_in_5, Caps=0)
brep_plane_2 = BrepPlane(Brep=pipe_2, Plane=pl_origin_2)  # -> Curves, Points
area_2 = Area(Geometry=brep_plane_2.Curves)  # -> Area, Centroid
louver_spacing_in_6 = Number(1.375)

# ----
curve_closest_point_2 = CurveClosestPoint(Point=area_2.Centroid, Curve=brep_plane_2.Curves)  # -> Point, Parameter, Distance

# ---- group: DETERIMINE TANGENT OFFSET FROM PIPE (continued)
addition_2 = Addition(A=curve_closest_point_2.Distance, B=louver_spacing_in_6)  # -> flatten(Result)

# ----
cir = Circle(Plane=pl_origin_2, Radius=addition_2)
cir_2 = Circle(Plane=pl_origin, Radius=addition)
short = ShortestList(ListA=cir, ListB=deconstruct_plane.Origin, TrimMode=1)  # -> ListA, ListB
short_2 = ShortestList(ListA=crv_cp.Point, ListB=cir_2, TrimMode=1)  # -> ListA, ListB
tan = TangentLines(Point=short.ListB, Circle=short.ListA)  # -> Tangent1, Tangent2
tan_2 = TangentLines(Point=short_2.ListA, Circle=short_2.ListB)  # -> Tangent1, Tangent2

curve = Curve(tan.Tangent2)
curve_2 = Curve(tan_2.Tangent1)
curve_3 = Curve(tan_2.Tangent2)
curve_4 = Curve(tan.Tangent1)

# ----
# Uniform Tangent Curves
cluster_2 = Cluster(t1=tan.Tangent1, t2=tan.Tangent2, center_of_pod=pt)  # disabled
cluster_3 = Cluster(t1=tan_2.Tangent1, t2=tan_2.Tangent2, center_of_pod=pt)  # disabled

preview = CustomPreview(Geometry=cluster_2, Shader=ColourSwatch(SwatchColor=RGB(255, 255, 255)))

ext = ExtendCurve(Curve=curve, Type=0, Start=0, End=num_4)
ext_2 = ExtendCurve(Curve=curve_2, Type=0, Start=0, End=num_4)
end_2 = EndPoints(Curve=ext)  # -> Start, End
end_3 = EndPoints(Curve=ext_2)  # -> Start, End
ln = Line(StartPoint=end_2.Start, EndPoint=end_2.End)
ln_2 = Line(StartPoint=end_3.Start, EndPoint=end_3.End)

# ---- group: Lines AB (before miter)
line = Line(ln)

# ---- group: Lines CD (before miter)
line_2 = Line(ln_2)

# ----
# Compound Miters
cluster_4 = Cluster_3(line=line)
cluster_5 = Cluster_3(line=line_2)
cluster_6 = Cluster_8(box_before_miters=cluster_5, inside_curve=crv_7)  # -> tilt_angle_2, check_angle_2, miter_angle_2, louver_meshes_with_miters_2, mesh_pts_2, longest_length_2, fastener_points_2
cluster_7 = Cluster_7(box_before_miters=cluster_4, inside_curve=crv_6)  # -> tilt_angle_2, check_angle_2, miter_angle_2, louver_meshes_with_miters_2, mesh_pts_2, longest_length_2, fastener_points_2

cluster_8 = Cluster_4(assigned_path=path_3, data=cluster_7.mesh_pts_2)
cluster_9 = Cluster_4(assigned_path=path_3, data=cluster_6.mesh_pts_2)

clean = CleanTree(Tree=line, CleanInvalid=True, CleanEmpty=False)
clean_2 = CleanTree(Tree=line_2, CleanInvalid=True, CleanEmpty=False)
flatten = FlattenTree(Tree=cluster_4, Path=path_3)
flatten_2 = FlattenTree(Tree=cluster_5, Path=path_3)
flatten_3 = FlattenTree(Tree=cluster_7.louver_meshes_with_miters_2, Path=path_3)
flatten_4 = FlattenTree(Tree=cluster_6.louver_meshes_with_miters_2, Path=path_3)
flatten_5 = FlattenTree(Tree=clean, Path=path_3)
flatten_6 = FlattenTree(Tree=clean_2, Path=path_3)
pt_2 = Point(cluster_9)
path_mapper = PathMapper(flatten, source="{A}", target="{A;0}")
path_mapper_2 = PathMapper(flatten_2, source="{A}", target="{A;1}")
path_mapper_3 = PathMapper(flatten_3, source="{A}", target="{A;0}")
path_mapper_4 = PathMapper(flatten_4, source="{A}", target="{A;1}")
path_mapper_5 = PathMapper(flatten_5, source="{A}", target="{A;0}")
path_mapper_6 = PathMapper(flatten_6, source="{A}", target="{A;1}")
path_mapper_7 = PathMapper(pt_2, source="{A;B}", target="{A;1;B}")
boxes_ab = Box(path_mapper)
boxes_cd = Box(path_mapper_2)
louvers_ab_mitered_meshes = Mesh(path_mapper_3)
louvers_cd_mitered_meshes = Mesh(path_mapper_4)
louvres_cd = Line(path_mapper_6)
mesh_pts_cd = Point(path_mapper_7)
louvres_ab = Line(path_mapper_5)
tilt_angle_ab = Number(cluster_7.tilt_angle_2)
tilt_angle_cd = Number(cluster_6.tilt_angle_2)
check_angle_ab = Number(cluster_7.check_angle_2)
miter_angle_ab = Number(cluster_7.miter_angle_2)
check_angle_cd = Number(cluster_6.check_angle_2)
miter_angle_cd = Number(cluster_6.miter_angle_2)
tilt_angle_cd_2 = ClusterOutput(tilt_angle_cd)
tilt_angle_ab_2 = ClusterOutput(tilt_angle_ab)
check_angle_ab_2 = ClusterOutput(check_angle_ab)
miter_angle_ab_2 = ClusterOutput(miter_angle_ab)
check_angle_cd_2 = ClusterOutput(check_angle_cd)
miter_angle_cd_2 = ClusterOutput(miter_angle_cd)

flatten_7 = FlattenTree(Tree=cluster_7.longest_length_2, Path=path_3)
flatten_8 = FlattenTree(Tree=cluster_6.longest_length_2, Path=path_3)
pt_3 = Point(cluster_8)
path_mapper_8 = PathMapper(flatten_7, source="{A}", target="{A;0}")
path_mapper_9 = PathMapper(flatten_8, source="{A}", target="{A;1}")
path_mapper_10 = PathMapper(pt_3, source="{A;B}", target="{A;0;B}")
c_d_fastener_points = Point(cluster_6.fastener_points_2)
a_b_fastener_points = Point(cluster_7.fastener_points_2)
longest_length_ab = Number(path_mapper_8)
longest_length_ab_2 = Number(path_mapper_9)
mesh_pts_ab = Point(path_mapper_10)
boxes_ab_2 = ClusterOutput(boxes_ab)
boxes_cd_2 = ClusterOutput(boxes_cd)
louvers_ab_mitered_meshes_2 = ClusterOutput(louvers_ab_mitered_meshes)
louvers_cd_mitered_meshes_2 = ClusterOutput(louvers_cd_mitered_meshes)
mesh_pts_ab_2 = ClusterOutput(mesh_pts_ab)
mesh_pts_cd_2 = ClusterOutput(mesh_pts_cd)
longest_length_ab_3 = ClusterOutput(longest_length_ab)
longest_length_ab_4 = ClusterOutput(longest_length_ab_2)
louvres_ab_2 = ClusterOutput(louvres_ab)
louvres_cd_2 = ClusterOutput(louvres_cd)
a_b_fastener_points_2 = ClusterOutput(a_b_fastener_points)
a_b_fastener_points_3 = ClusterOutput(c_d_fastener_points)

# ==== cluster Cluster_13
louvre_width = ClusterInput()
louvre_depth = ClusterInput()
width_scaling_factor = ClusterInput()
typ_spacing = ClusterInput()
louvre_centerlines_with_gaps = ClusterInput()
width_scaling_factor_2 = Number(width_scaling_factor)
louvre_centerlines_with_gaps_2 = Line(louvre_centerlines_with_gaps)
louvre_depth_2 = XSize(louvre_depth)
louvre_width_2 = XSize(louvre_width)

# ---- group: Spacing parameters
num = Number(200)
num_2 = Number(6)

# ---- group: First 'Unfolded' Plane
O = Origin(Point(2483.196836, 13.26720647, 1204.801148))

# ----
cluster = Cluster_12(first_pt=O, spacing_between_fronds=num, spine_gap=num_2, louver_cl=louvre_centerlines_with_gaps_2)

# ---- group: Length domain (Z)
cluster_2 = Cluster_11(crv=louvre_centerlines_with_gaps_2, gap="0")

# ---- group: Fron Pts (unfolded)
pt = Point(cluster)

# ----
line = Line(louvre_centerlines_with_gaps_2)

# ----
# In this version, louvers are set-out at a typical spacing distance.
lng = ListLength(List=line)
split = SplitTree(Data=pt, Masks=flatten("{*;0}"))  # -> Positive, Negative
split_2 = SplitTree(Data=lng, Masks=flatten("{*;0}"))  # -> Positive, Negative
typ_spacing_2 = Number(typ_spacing)
series = Series(Start=expr("x / 2", typ_spacing_2), Step=typ_spacing_2, Count=split_2.Negative)
series_2 = Series(Start="0", Step=typ_spacing_2, Count=split_2.Positive)
pshift = ShiftPaths(Data=series_2, Offset=-1)
pshift_2 = ShiftPaths(Data=series, Offset=-1)
Y = UnitY(Factor=pshift)
Y_2 = UnitY(Factor=pshift_2)
rev = Reverse(Vector=Y)
rev_2 = Reverse(Vector=Y_2)
move = Move(Geometry=split.Positive, Motion=rev)  # -> Geometry, Transform
move_2 = Move(Geometry=split.Negative, Motion=rev_2)  # -> Geometry, Transform
merge = Merge(Data1=move.Geometry, Data2=move_2.Geometry)
xy = XYPlane(Origin=merge)

# ----
# In this version, instead of using 'unfolded surfaces' to distribute the louvers
# we use lines oriented to the Y axis and distribute XY planes along each line
# to represent the staggered layout of the louvers
end = EndPoints(Curve=louvre_centerlines_with_gaps_2)  # -> Start, End
pt_2 = Point(end.Start)
intcrv = Interpolate(Vertices=pt_2, Degree=3, Periodic=False, KnotStyle=1)  # -> Curve, Length, Domain
len = Length(Curve=intcrv.Curve)
crv_cp = CurveClosestPoint(Point=pt_2, Curve=intcrv.Curve)  # -> Point, Parameter, Distance
lenp = LengthParameter(Curve=intcrv.Curve, Parameter=crv_cp.Parameter)  # -> Length, Length_2
multiplication = Multiplication(A=len, B=width_scaling_factor_2)
multiplication_2 = Multiplication(A=lenp.Length, B=width_scaling_factor_2)
addition = Addition(A=multiplication, B="10")
Y_3 = UnitY(Factor=-1)
line_2 = LineSDL(Start=cluster, Direction=Y_3, Length=addition)
eval = EvaluateLength(Curve=line_2, Length=multiplication_2, Normalized=False)  # -> Point, Tangent, Parameter
xy_2 = XYPlane(Origin=eval.Point)

# ----
# Flip the louvers horizontally
# every other branch of data
split_3 = SplitTree(Data=cluster_2, Masks=flatten("{*;0}"))  # -> Positive, Negative
neg = Negative(Value=split_3.Positive)
merge_2 = Merge(Data1=neg, Data2=split_3.Negative)

domain = Domain(louvre_width_2)
domain_2 = Domain(louvre_depth_2)
box = DomainBox(Base=xy, X=merge_2, Y=domain, Z=domain_2)
louvre_boxes = Box(box)
preview = CustomPreview(Geometry=louvre_boxes, Shader=ColourSwatch(SwatchColor=RGB(255, 253, 120)))
louvre_boxes_2 = ClusterOutput(louvre_boxes)

# ==== cluster ARCH
decimal_inputs = ClusterInput()
units = ClusterInput()
units_2 = Integer(units)
filter = StreamFilter(Gate=units_2, Stream0="1", Stream1="1/12", Stream2="3.2808399", Stream3="0.0032808399")
fraction_denominator = ClusterInput()
split = StringSplit(DecimalInputs=decimal_inputs)
cull = CullPattern(List=split, CullPattern=[True, False])
multiplication = Multiplication(DecimalInputs=cull, B=filter)
num = Number(multiplication)
split_2 = StringSplit(String=num, Separators=".")
fraction_denominator_2 = Integer(fraction_denominator)
panel = Panel("fractions")
panel_2 = Panel("inches")
item = ListItem(List=split_2, Index=1, Wrap=False)
panel_3 = Panel("feet")
fraction_denominator_3 = Panel(fraction_denominator_2)
item_2 = ListItem(List=split_2, Index=0, Wrap=False)
graft = GraftTree(Data=flatten(item), Strip=False)
graft_2 = GraftTree(Data=flatten("."), Strip=False)
graft_3 = GraftTree(Data=flatten(item_2), Strip=False)
graft_4 = GraftTree(Data=flatten("'"), Strip=False)
concat = Concatenate(Start=graft_2, End=graft)
int = Integer(graft_3)
multiplication_2 = Multiplication(A=concat, B="12")
concat_2 = Concatenate(Start=int, End=graft_4)
num_2 = Number(multiplication_2)
split_3 = StringSplit(String=num_2, Separators=".")
item_3 = ListItem(List=split_3, Index=0, Wrap=False)
item_4 = ListItem(List=split_3, Index=1, Wrap=False)
graft_5 = GraftTree(Data=flatten(item_3), Strip=False)
graft_6 = GraftTree(Data=flatten(item_4), Strip=False)
graft_7 = GraftTree(Data=flatten("."), Strip=False)
concat_3 = Concatenate(Start=graft_7, End=graft_6)
denom = Integer(fraction_denominator_3)
multiplication_3 = Multiplication(A=concat_3, B=denom)
series = Series(Start=1, Step=1, Count=expr("x-1", fraction_denominator_3))
numer = Integer(multiplication_3)
inches = Panel(concat_3)
division = Division(A=numer, B=series)
division_2 = Division(A=fraction_denominator_3, B=series)
lng = ListLength(List=series)
equals = Equality(FirstNumber=division, SecondNumber=flatten(division_2), DataComparison="cross_reference")  # -> Equality, Inequality
dup = DuplicateData(Data=division, Number=lng, Order=True)
path_mapper = PathMapper(dup, source="{A;B;C}", target="{A;B}")
panel_4 = Panel(dup)
inches_2 = Panel(division)
cull_2 = CullPattern(List=path_mapper, CullPattern=equals.Equality)
sort = SortList(Keys=cull_2, ValuesA=cull_2)  # -> List, ValuesA
rev = ReverseList(List=sort.ValuesA)
item_5 = ListItem(List=rev, Index=0, Wrap=False)
panel_5 = Panel(equals.Equality)
path_mapper_2 = PathMapper(item_5, source=["{A;B}", "{A;B;C}", "{A;B;C;D}", "{A;B;C;D;E}"], target=["{A;B}", "{A;B}", "{A;B}", "{A;B}"])
lng_2 = ListLength(List=flatten(path_mapper_2))
null = NullItem(Items=path_mapper_2)  # -> NullFlags, InvalidFlags
series_2 = Series(Start=0, Step=1, Count=lng_2)
dispatch = Dispatch(List=graft(series_2), DispatchPattern=null.NullFlags)  # -> ListA, ListB
dispatch_2 = Dispatch(List=path_mapper_2, DispatchPattern=null.NullFlags)  # -> ListA, ListB
lng_3 = ListLength(List=flatten(dispatch_2.ListA))
merge = Merge(StreamA=flatten(dispatch.ListA), StreamB=flatten(dispatch.ListB))
graft_8 = GraftTree(Data=dispatch_2.ListB, Strip=False)
dup_2 = DuplicateData(Data="0", Number=lng_3, Order=True)
num_3 = Number(graft(merge))
merge_2 = Merge(StreamA=graft_8, StreamB=dup_2)
sort_2 = SortList(Keys=flatten(num_3), ValuesA=flatten(merge_2))  # -> List, ValuesA
panel_6 = Panel(numer)
graft_9 = GraftTree(Data=flatten(sort_2.ValuesA), Strip=False)
graft_10 = GraftTree(Data=flatten(numer), Strip=False)
equals_2 = Equality(FirstNumber=graft_9, SecondNumber="0")  # -> Equality, Inequality
graft_11 = GraftTree(Data=flatten(fraction_denominator_3), Strip=False)
equals_3 = Equality(FirstNumber=graft_9, SecondNumber="0")  # -> Equality, Inequality
int_2 = Integer(equals_2.Equality)
int_3 = Integer(equals_3.Equality)
addition = Addition(A=graft_9, B=int_3)
addition_2 = Addition(A=graft_9, B=int_2)
division_3 = Division(A=graft_10, B=addition_2)
division_4 = Division(A=flatten(graft_11), B=addition)
lng_4 = ListLength(List=sort_2.ValuesA)
panel_7 = Panel(division_4)
panel_8 = Panel(division_3)
lng_5 = ListLength(List=sort_2.ValuesA)
lng_6 = ListLength(List=sort_2.ValuesA)
repeat = RepeatData(Data="-", Length=lng_4)
repeat_2 = RepeatData(Data="/", Length=lng_5)
repeat_3 = RepeatData(Data="\"", Length=lng_6)
graft_12 = GraftTree(Data=flatten(repeat), Strip=False)
graft_13 = GraftTree(Data=flatten(repeat_2), Strip=False)
int_4 = Integer(division_4)
graft_14 = GraftTree(Data=flatten(repeat_3), Strip=False)
int_5 = Integer(division_3)
join = StringJoin(Strings=[graft_12, int_5, graft_13, int_4, graft_14])
int_6 = Integer(fraction_denominator_3)
join_2 = StringJoin(Strings=["-0/", int_6, "\""])
panel_9 = Panel(join_2)
rep = ReplaceString(String=join, Find=join_2, Replace="\"", RecursiveReplace=False)
int_7 = Integer(fraction_denominator_3)
join_3 = StringJoin(Strings=["-/", int_7, "\""])
panel_10 = Panel(concat_2)
panel_11 = Panel(graft_5)
panel_12 = Panel(join_3)
rep_2 = ReplaceString(String=rep, Find=join_3, Replace="0\"", RecursiveReplace=False)
panel_13 = Panel(rep_2)
join_4 = StringJoin(Strings=[panel_10, panel_11, panel_13])
panel_14 = Panel(join_4)
arch_dim = ClusterOutput(join_4)

# ==== cluster Cluster_14
L = ClusterInput()
extension = ClusterInput()
L_2 = Line(L)
extension_2 = Number(extension)
end = EndPoints(Curve=L_2)  # -> Start, End
amp = Amplitude(Vector=L_2, Amplitude=extension_2)
move = Move(Geometry=end.End, Motion=amp)  # -> Geometry, Transform
ln = Line(StartPoint=end.Start, EndPoint=move.Geometry)
L_3 = ClusterOutput(ln)

# ==== cluster Cluster
t2 = ClusterInput()
t1 = ClusterInput()
t2_2 = Line(t2)
t1_2 = Line(t1)
merge = Merge(Data1=graft(t1_2), Data2=graft(t2_2))
rib_crv = Curve(merge)
item = ListItem(List=rib_crv, Index=0, Wrap=True)
item_2 = ListItem(List=rib_crv, Index=1, Wrap=True)
center_of_pod = ClusterInput()
end = EndPoints(Curve=item)  # -> Start, End
end_2 = EndPoints(Curve=item_2)  # -> Start, End
center_of_pod_2 = Point(center_of_pod)
pt = Point(end.End)
pt_2 = Point(end_2.End)
project = Project(Geometry=pt, Plane=PlaneXY(0, 0, 0))  # -> Geometry, Transform
project_2 = Project(Geometry=pt_2, Plane=PlaneXY(0, 0, 0))  # -> Geometry, Transform
project_3 = Project(Geometry=center_of_pod_2, Plane=PlaneXY(0, 0, 0))  # -> Geometry, Transform
dist = Distance(PointA=project.Geometry, PointB=project_3.Geometry)
dist_2 = Distance(PointA=project_2.Geometry, PointB=project_3.Geometry)
smaller = SmallerThan(FirstNumber=dist, SecondNumber=dist_2)  # -> SmallerThan, OrEqualTo
not = GateNot(A=smaller.SmallerThan)
merge_2 = Merge(Data1=smaller.SmallerThan, Data2=not)
cull = CullPattern(List=rib_crv, CullPattern=merge_2)  # -> flatten(List)
tangent_lines = Line(cull)
tangent_lines_2 = ClusterOutput(tangent_lines)

# ==== cluster Cluster_2
box_before_miters = ClusterInput()
inside_curve = ClusterInput()
box_before_miters_2 = Box(box_before_miters)
inside_curve_2 = Curve(inside_curve)
edges = BrepEdges(Brep=box_before_miters_2)  # -> Naked, Interior, NonManifold
panel = Panel("""8
9
10
11""")
item = ListItem(List=edges.Interior, Index=panel, Wrap=True)
planar = Planar(Curve=inside_curve_2)  # -> Planar, Plane, Deviation
line = Line(item)
plx = LinePlane(Line=line, Plane=planar.Plane)  # -> Point, ParamL, ParamP
end = EndPoints(Curve=line)  # -> Start, End

# ---- group: FASTENER LOCATIONS
panel_2 = Panel("""0
1""")
panel_3 = Panel("""2
3""")
item_2 = ListItem(List=plx.Point, Index=panel_2, Wrap=True)
item_3 = ListItem(List=plx.Point, Index=panel_3, Wrap=True)
dispatch = Dispatch(List=item_2, DispatchPattern=[True, False])  # -> ListA, ListB
dispatch_2 = Dispatch(List=item_3, DispatchPattern=[True, False])  # -> ListA, ListB
ln = Line(StartPoint=dispatch.ListA, EndPoint=dispatch.ListB)
ln_2 = Line(StartPoint=dispatch_2.ListA, EndPoint=dispatch_2.ListB)
number = Number(0.5)
evaluate_curve = EvaluateCurve(Curve=ln, Parameter=number)  # -> Point, Tangent, Angle
evaluate_curve_2 = EvaluateCurve(Curve=ln_2, Parameter=number)  # -> Point, Tangent, Angle
vector_2pt = Vector2Pt(PointA=evaluate_curve.Point, PointB=evaluate_curve_2.Point, Unitize=False)  # -> Vector, Length
ln_3 = Line(StartPoint=evaluate_curve.Point, EndPoint=evaluate_curve_2.Point)
evaluate_curve_3 = EvaluateCurve(Curve=ln_3, Parameter=number)  # -> Point, Tangent, Angle
number_2 = Number(0.75)
neg = Negative(Value=number_2)
amplitude = Amplitude(Vector=vector_2pt.Vector, Amplitude=number_2)
amplitude_2 = Amplitude(Vector=vector_2pt.Vector, Amplitude=neg)
move = Move(Geometry=evaluate_curve_3.Point, Motion=amplitude)  # -> Geometry, Transform
move_2 = Move(Geometry=evaluate_curve_3.Point, Motion=amplitude_2)  # -> Geometry, Transform
merge = Merge(Data1=move_2.Geometry, Data2=move.Geometry)
distance = Distance(PointA=move_2.Geometry, PointB=move.Geometry)
fastener_points = Point(merge)

# ----
pt = Point(end.End)
panel_4 = Panel("""Q{0;1;2;3}
Q{4;5;6;7}""")
panel_5 = Panel("""Q{1;2;6;5}
Q{3;0;4;7}""")
panel_6 = Panel("""Q{0;1;5;4}
Q{2;3;7;6}""")
merge_2 = Merge(Data1=pt, Data2=plx.Point)
ln_4 = Line(StartPoint=pt, EndPoint=plx.Point)
conmesh = ConstructMesh(Vertices=merge_2, Faces=panel_4)
conmesh_2 = ConstructMesh(Vertices=merge_2, Faces=panel_5)
conmesh_3 = ConstructMesh(Vertices=merge_2, Faces=panel_6)
len = Length(Curve=ln_4)
sort = SortList(Keys=len, ValuesA=ln_4)  # -> Keys, ValuesA
merge_3 = Merge(Data1=conmesh, Data2=conmesh_2, Data3=conmesh_3)
item_4 = ListItem(List=reverse(sort.Keys), Index=0, Wrap=True)
item_5 = ListItem(List=reverse(sort.ValuesA), Index=0, Wrap=True)
mjoin = MeshJoin(Meshes=merge_3)
louver_meshes_with_miters = Mesh(flatten(mjoin))

# ---- group: Longest Length
longest_length = Number(flatten(item_4))

# ----
divide = DivideCurve(Curve=item_5, Count=10, Kinks=False)  # -> Points, Tangents, Parameters
mesh_pts = Point(merge_2)
louver_meshes_with_miters_2 = ClusterOutput(louver_meshes_with_miters)
mesh_pts_2 = ClusterOutput(mesh_pts)
longest_length_2 = ClusterOutput(longest_length)

series = Series(Start=0, Step=1, Count=8)
int = Integer(series)
tag = TextTag(Location=merge_2, Text=int, Colour=ColourSwatch(SwatchColor=RGB(255, 255, 255)))
preview = CustomPreview(Geometry=mjoin, Shader=ColourSwatch(SwatchColor=RGB(102, 158, 255)))

panel_7 = Panel(distance)
fastener_points_2 = ClusterOutput(fastener_points)

# ---- group: MITER ANGLE
deconstruct_box = DeconstructBox(Box=box_before_miters_2)  # -> Plane, X, Y, Z
deconstruct_plane = DeconstructPlane(Plane=deconstruct_box.Plane)  # -> Origin, XAxis, YAxis, ZAxis
construct_plane = ConstructPlane(Origin=deconstruct_plane.Origin, XAxis=deconstruct_plane.ZAxis, YAxis=deconstruct_plane.YAxis)  # -> graft(Plane)
rectangle = Rectangle(Plane=construct_plane, XSize="-48 to 48", YSize="-8 to 8", Radius=0)  # -> Rectangle, Length
boundary_surfaces = BoundarySurfaces(Edges=rectangle.Rectangle)
brep_plane = BrepPlane(Brep=boundary_surfaces, Plane=planar.Plane)  # -> Curves, Points
shift_paths = ShiftPaths(Data=brep_plane.Curves, Offset=-1)
clean_tree = CleanTree(Tree=shift_paths, CleanInvalid=True, CleanEmpty=invert(False))
end_points = EndPoints(Curve=clean_tree)  # -> Start, End
vector_2pt_2 = Vector2Pt(PointA=end_points.Start, PointB=end_points.End, Unitize=False)  # -> Vector, Length
tree_statistics = TreeStatistics(Tree=clean_tree)  # -> Paths, Length, Count
tree_branch = TreeBranch(Tree=construct_plane, Path=tree_statistics.Paths, MaintainPaths=True)
deconstruct_plane_2 = DeconstructPlane(Plane=tree_branch)  # -> Origin, XAxis, YAxis, ZAxis

# ---- group: MITER ANGLE / miter line
m = Line(StartPoint=end_points.Start, EndPoint=end_points.End)

# ---- group: MITER ANGLE (continued)
perp_frame = PerpFrame(Curve=m, Parameter="0.5")
deconstruct_plane_3 = DeconstructPlane(Plane=perp_frame)  # -> Origin, XAxis, YAxis, ZAxis
align_plane = AlignPlane(Plane=perp_frame, Direction=deconstruct_plane_2.XAxis)  # -> Plane, Angle
line_sdl = LineSDL(Start=deconstruct_plane_3.Origin, Direction=deconstruct_plane_2.XAxis, Length="6")
line_sdl_2 = LineSDL(Start=deconstruct_plane_3.Origin, Direction=vector_2pt_2.Vector, Length="6")
angle = Angle(VectorA=line_sdl, VectorB=line_sdl_2)  # -> Angle, Reflex
degrees = Degrees(Radians=angle.Angle)
end_points_2 = EndPoints(Curve=line_sdl)  # -> Start, End
end_points_3 = EndPoints(Curve=line_sdl_2)  # -> Start, End
angular_dimension = AngularDimension(
    Center=deconstruct_plane_3.Origin,
    PointA=end_points_2.End,
    PointB=end_points_3.End,
    Reflex=False,
    Text="{0:0.0}°",
    Size=1)
round = Round(Number=degrees)  # -> Nearest, Floor, Ceiling
miter_angle = Number(round.Nearest)

# ---- group: TILT ANGLE
graft_tree = GraftTree(Tree=deconstruct_box.Plane, IncludeEmptyLists=True, IncludeNullItems=True)
plane_origin = PlaneOrigin(Base=graft_tree, Origin=perp_frame)
deconstruct_plane_4 = DeconstructPlane(Plane=plane_origin)  # -> Origin, XAxis, YAxis, ZAxis
construct_plane_2 = ConstructPlane(Origin=deconstruct_plane_4.Origin, XAxis=deconstruct_plane_4.XAxis, YAxis=deconstruct_plane_4.ZAxis)
rectangle_2 = Rectangle(Plane=construct_plane_2, XSize="-2 to 2", YSize="-4 to 4", Radius=0)  # -> Rectangle, Length
boundary_surfaces_2 = BoundarySurfaces(Edges=rectangle_2.Rectangle)
brep_plane_2 = BrepPlane(Brep=boundary_surfaces_2, Plane=planar.Plane)  # -> Curves, Points
shift_paths_2 = ShiftPaths(Data=brep_plane_2.Curves, Offset=-1)
clean_tree_2 = CleanTree(Tree=shift_paths_2, CleanInvalid=True, CleanEmpty=invert(False))
end_points_4 = EndPoints(Curve=clean_tree_2)  # -> Start, End
m_2 = Line(StartPoint=end_points_4.Start, EndPoint=end_points_4.End)
vector_2pt_3 = Vector2Pt(PointA=end_points_4.End, PointB=end_points_4.Start, Unitize=False)  # -> Vector, Length
tree_statistics_2 = TreeStatistics(Tree=clean_tree_2)  # -> Paths, Length, Count
tree_branch_2 = TreeBranch(Tree=construct_plane, Path=tree_statistics_2.Paths, MaintainPaths=True)
perp_frame_2 = PerpFrame(Curve=m_2, Parameter="0.5")
deconstruct_plane_5 = DeconstructPlane(Plane=tree_branch_2)  # -> Origin, XAxis, YAxis, ZAxis
deconstruct_plane_6 = DeconstructPlane(Plane=perp_frame_2)  # -> Origin, XAxis, YAxis, ZAxis
align_plane_2 = AlignPlane(Plane=perp_frame_2, Direction=deconstruct_plane_5.XAxis)  # -> Plane, Angle
line_sdl_3 = LineSDL(Start=deconstruct_plane_6.Origin, Direction=deconstruct_plane_5.XAxis, Length="3")
line_sdl_4 = LineSDL(Start=deconstruct_plane_6.Origin, Direction=vector_2pt_3.Vector, Length="3")
angle_2 = Angle(VectorA=line_sdl_3, VectorB=line_sdl_4)  # -> Angle, Reflex
degrees_2 = Degrees(Radians=angle_2.Angle)
end_points_5 = EndPoints(Curve=line_sdl_3)  # -> Start, End
end_points_6 = EndPoints(Curve=line_sdl_4)  # -> Start, End
angular_dimension_2 = AngularDimension(
    Center=deconstruct_plane_6.Origin,
    PointA=end_points_6.End,
    PointB=end_points_5.End,
    Reflex=False,
    Text="{0:0.0}°",
    Size=1)
round_2 = Round(Number=degrees_2)  # -> Nearest, Floor, Ceiling
check_angle = Number(round_2.Nearest)

# ----
panel_8 = Panel(perp_frame)
check_angle_2 = ClusterOutput(check_angle)
panel_9 = Panel(check_angle)
tilt_angle = ClusterOutput(miter_angle)
panel_10 = Panel(degrees)

# ---- group: TILT ANGLE
rectangle_3 = Rectangle(Plane=perp_frame, XSize="-2 to 2", YSize="-2 to 2", Radius=0)  # -> Rectangle, Length
boundary_surfaces_3 = BoundarySurfaces(Edges=rectangle_3.Rectangle)
brep_plane_3 = BrepPlane(Brep=boundary_surfaces_3, Plane=planar.Plane)  # -> Curves, Points
shift_paths_3 = ShiftPaths(Data=brep_plane_3.Curves, Offset=-1)
clean_tree_3 = CleanTree(Tree=shift_paths_3, CleanInvalid=True, CleanEmpty=invert(False))
end_points_7 = EndPoints(Curve=clean_tree_3)  # -> Start, End
m_3 = Line(StartPoint=end_points_7.Start, EndPoint=end_points_7.End)
vector_2pt_4 = Vector2Pt(PointA=end_points_7.Start, PointB=end_points_7.End, Unitize=False)  # -> Vector, Length
tree_statistics_3 = TreeStatistics(Tree=clean_tree_3)  # -> Paths, Length, Count
tree_branch_3 = TreeBranch(Tree=construct_plane, Path=tree_statistics_3.Paths, MaintainPaths=True)
deconstruct_plane_7 = DeconstructPlane(Plane=tree_branch_3)  # -> Origin, XAxis, YAxis, ZAxis
angle_3 = Angle(VectorA=deconstruct_plane_7.XAxis, VectorB=m_3)  # -> Angle, Reflex
perp_frame_3 = PerpFrame(Curve=m_3, Parameter="0.5")
align_plane_3 = AlignPlane(Plane=perp_frame_3, Direction=deconstruct_plane_7.XAxis)  # -> Plane, Angle
degrees_3 = Degrees(Radians=angle_3.Angle)
line_sdl_5 = LineSDL(Start=deconstruct_plane_7.Origin, Direction=deconstruct_plane_7.XAxis, Length="3")
line_sdl_6 = LineSDL(Start=deconstruct_plane_7.Origin, Direction=vector_2pt_4.Vector, Length="3")
end_points_8 = EndPoints(Curve=line_sdl_5)  # -> Start, End
end_points_9 = EndPoints(Curve=line_sdl_6)  # -> Start, End
angular_dimension_3 = AngularDimension(
    Center=deconstruct_plane_7.Origin,
    PointA=end_points_8.End,
    PointB=end_points_9.End,
    Reflex=False,
    Text="{0:0.0}°",
    Size=1)

# ----
round_3 = Round(Number=degrees_3)  # -> Nearest, Floor, Ceiling
tilt_angle_2 = Number(round_3.Nearest)
tilt_angle_3 = ClusterOutput(tilt_angle_2)

# ---- group: TILT ANGLE (continued)
panel_11 = Panel(tilt_angle_2)

# ==== cluster Cluster_3
line = ClusterInput()
line_2 = Line(line)
clean_tree = CleanTree(Tree=line_2, CleanInvalid=True, CleanEmpty=False)
loft = Loft(Curves=clean_tree, Options={Adjust=False, Closed=False, LoftEnds=0, LoftSimp=0, LoftType=0, Rebuild=10, Refit=0.01})
petal_srf_trimmed = Surface(loft)
louvre_lines = Curve(line_2)
eval = EvaluateCurve(Curve=reparameterize(louvre_lines), Parameter=0.5)  # -> Point, Tangent, Angle
srf_cp = SurfaceClosestPoint(Point=eval.Point, Surface=petal_srf_trimmed)  # -> Point, UVPoint, Distance
evalsrf = EvaluateSurface(Surface=petal_srf_trimmed, Point=srf_cp.UVPoint)  # -> Point, Normal, Frame
vec = Vector(louvre_lines)
align = AlignPlane(Plane=evalsrf.Frame, Direction=vec)  # -> Plane, Angle
deplane = DeconstructPlane(Plane=align.Plane)  # -> Origin, XAxis, YAxis, ZAxis
len = Length(Curve=line_2)
dom = ConstructDomain(DomainStart=expr("x * -0.5", len), DomainEnd=expr("x * 0.5", len))
pl = ConstructPlane(Origin=deplane.Origin, XAxis=deplane.YAxis, YAxis=deplane.ZAxis)
box = DomainBox(Base=pl, X=Domain(-0.5, 0.5), Y=Domain(-1.25, 1.25), Z=dom)
box_2 = ClusterOutput(box)

# ==== cluster Cluster_4
data = ClusterInput()
assigned_path = ClusterInput()
data_2 = Data(data)
assigned_path_2 = DataPath(assigned_path)
viewer = ParamViewer(data_2)
dpath = DeconstructPath(Branch=assigned_path_2)
dpath_2 = DeconstructPath(Branch=viewer)
item = ListItem(List=dpath_2, Index=1, Wrap=True)  # -> flatten(Item)
expression = Expression(x=dpath, y=item, Expression="Format(\"{{{0};{1}}}\", x, y)")
replace = ReplacePaths(Data=data_2, Search=viewer, Replace=expression)
data_3 = Data(replace)
data_4 = ClusterOutput(data_3)

# ==== cluster Cluster_5
center_pipe_curve = ClusterInput()
outside_curve_a = ClusterInput()
a_planes = ClusterInput()
outside_curve_d = ClusterInput()
d_planes = ClusterInput()
center_pipe_curve_2 = Curve(center_pipe_curve)
outside_curve_a_2 = Curve(outside_curve_a)
a_planes_2 = Plane(a_planes)
outside_curve_d_2 = Curve(outside_curve_d)
d_planes_2 = Plane(d_planes)
curve_plane = CurvePlane(Curve=outside_curve_a_2, Plane=a_planes_2)  # -> Points, ParamsC, ParamsP
curve_plane_2 = CurvePlane(Curve=outside_curve_d_2, Plane=d_planes_2)  # -> Points, ParamsC, ParamsP
panel = Panel("""0
10
20
30
40
50
60
70
80
90""")
curve_plane_3 = CurvePlane(Curve=center_pipe_curve_2, Plane=a_planes_2)  # -> Points, ParamsC, ParamsP
curve_plane_4 = CurvePlane(Curve=center_pipe_curve_2, Plane=d_planes_2)  # -> Points, ParamsC, ParamsP
line = Line(StartPoint=curve_plane.Points, EndPoint=curve_plane_3.Points)  # -> flatten(Line)
list_item = ListItem(List=line, Index=panel, Wrap=True)
line_2 = Line(StartPoint=curve_plane_2.Points, EndPoint=curve_plane_4.Points)  # -> flatten(Line)
list_item_2 = ListItem(List=line_2, Index=panel, Wrap=True)
merge = Merge(Data1=list_item, Data2=list_item_2)
number = Number(1.1875)
curve = Curve(line_2)
curve_2 = Curve(line)
pipe = Pipe(Curve=merge, Radius=number, Caps=0)
diagonal_struts = Brep(pipe)
strut_center_lines = Curve(merge)
diagonal_struts_2 = ClusterOutput(diagonal_struts)
strut_center_lines_2 = ClusterOutput(strut_center_lines)

# ==== cluster Cluster_7
box_before_miters = ClusterInput()
inside_curve = ClusterInput()
box_before_miters_2 = Box(box_before_miters)
inside_curve_2 = Curve(inside_curve)
edges = BrepEdges(Brep=box_before_miters_2)  # -> Naked, Interior, NonManifold
panel = Panel("""8
9
10
11""")
item = ListItem(List=edges.Interior, Index=panel, Wrap=True)
planar = Planar(Curve=inside_curve_2)  # -> Planar, Plane, Deviation
line = Line(item)
plx = LinePlane(Line=line, Plane=planar.Plane)  # -> Point, ParamL, ParamP
end = EndPoints(Curve=line)  # -> Start, End

# ---- group: FASTENER LOCATIONS
panel_2 = Panel("""0
1""")
panel_3 = Panel("""2
3""")
item_2 = ListItem(List=plx.Point, Index=panel_2, Wrap=True)
item_3 = ListItem(List=plx.Point, Index=panel_3, Wrap=True)
dispatch = Dispatch(List=item_2, DispatchPattern=[True, False])  # -> ListA, ListB
dispatch_2 = Dispatch(List=item_3, DispatchPattern=[True, False])  # -> ListA, ListB
ln = Line(StartPoint=dispatch.ListA, EndPoint=dispatch.ListB)
ln_2 = Line(StartPoint=dispatch_2.ListA, EndPoint=dispatch_2.ListB)
number = Number(0.5)
evaluate_curve = EvaluateCurve(Curve=ln, Parameter=number)  # -> Point, Tangent, Angle
evaluate_curve_2 = EvaluateCurve(Curve=ln_2, Parameter=number)  # -> Point, Tangent, Angle
vector_2pt = Vector2Pt(PointA=evaluate_curve.Point, PointB=evaluate_curve_2.Point, Unitize=False)  # -> Vector, Length
ln_3 = Line(StartPoint=evaluate_curve.Point, EndPoint=evaluate_curve_2.Point)
evaluate_curve_3 = EvaluateCurve(Curve=ln_3, Parameter=number)  # -> Point, Tangent, Angle
number_2 = Number(0.75)
neg = Negative(Value=number_2)
amplitude = Amplitude(Vector=vector_2pt.Vector, Amplitude=number_2)
amplitude_2 = Amplitude(Vector=vector_2pt.Vector, Amplitude=neg)
move = Move(Geometry=evaluate_curve_3.Point, Motion=amplitude)  # -> Geometry, Transform
move_2 = Move(Geometry=evaluate_curve_3.Point, Motion=amplitude_2)  # -> Geometry, Transform
merge = Merge(Data1=move_2.Geometry, Data2=move.Geometry)
distance = Distance(PointA=move_2.Geometry, PointB=move.Geometry)
fastener_points = Point(merge)

# ----
pt = Point(end.End)
panel_4 = Panel("""Q{0;1;2;3}
Q{4;5;6;7}""")
panel_5 = Panel("""Q{1;2;6;5}
Q{3;0;4;7}""")
panel_6 = Panel("""Q{0;1;5;4}
Q{2;3;7;6}""")
merge_2 = Merge(Data1=pt, Data2=plx.Point)
ln_4 = Line(StartPoint=pt, EndPoint=plx.Point)
conmesh = ConstructMesh(Vertices=merge_2, Faces=panel_4)
conmesh_2 = ConstructMesh(Vertices=merge_2, Faces=panel_5)
conmesh_3 = ConstructMesh(Vertices=merge_2, Faces=panel_6)
len = Length(Curve=ln_4)
sort = SortList(Keys=len, ValuesA=ln_4)  # -> Keys, ValuesA
merge_3 = Merge(Data1=conmesh, Data2=conmesh_2, Data3=conmesh_3)
item_4 = ListItem(List=reverse(sort.Keys), Index=0, Wrap=True)
item_5 = ListItem(List=reverse(sort.ValuesA), Index=0, Wrap=True)
mjoin = MeshJoin(Meshes=merge_3)
louver_meshes_with_miters = Mesh(flatten(mjoin))

# ---- group: Longest Length
longest_length = Number(flatten(item_4))

# ----
divide = DivideCurve(Curve=item_5, Count=10, Kinks=False)  # -> Points, Tangents, Parameters
mesh_pts = Point(merge_2)
louver_meshes_with_miters_2 = ClusterOutput(louver_meshes_with_miters)
mesh_pts_2 = ClusterOutput(mesh_pts)
longest_length_2 = ClusterOutput(longest_length)

series = Series(Start=0, Step=1, Count=8)
int = Integer(series)
tag = TextTag(Location=merge_2, Text=int, Colour=ColourSwatch(SwatchColor=RGB(255, 255, 255)))
preview = CustomPreview(Geometry=mjoin, Shader=ColourSwatch(SwatchColor=RGB(102, 158, 255)))

panel_7 = Panel(distance)
fastener_points_2 = ClusterOutput(fastener_points)

# ---- group: MITER ANGLE
deconstruct_box = DeconstructBox(Box=box_before_miters_2)  # -> Plane, X, Y, Z
deconstruct_plane = DeconstructPlane(Plane=deconstruct_box.Plane)  # -> Origin, XAxis, YAxis, ZAxis
construct_plane = ConstructPlane(Origin=deconstruct_plane.Origin, XAxis=deconstruct_plane.ZAxis, YAxis=deconstruct_plane.YAxis)  # -> graft(Plane)
rectangle = Rectangle(Plane=construct_plane, XSize="-48 to 48", YSize="-8 to 8", Radius=0)  # -> Rectangle, Length
boundary_surfaces = BoundarySurfaces(Edges=rectangle.Rectangle)
brep_plane = BrepPlane(Brep=boundary_surfaces, Plane=planar.Plane)  # -> Curves, Points
shift_paths = ShiftPaths(Data=brep_plane.Curves, Offset=-1)
clean_tree = CleanTree(Tree=shift_paths, CleanInvalid=True, CleanEmpty=invert(False))
end_points = EndPoints(Curve=clean_tree)  # -> Start, End
vector_2pt_2 = Vector2Pt(PointA=end_points.Start, PointB=end_points.End, Unitize=False)  # -> Vector, Length
tree_statistics = TreeStatistics(Tree=clean_tree)  # -> Paths, Length, Count
tree_branch = TreeBranch(Tree=construct_plane, Path=tree_statistics.Paths, MaintainPaths=True)
deconstruct_plane_2 = DeconstructPlane(Plane=tree_branch)  # -> Origin, XAxis, YAxis, ZAxis

# ---- group: MITER ANGLE / miter line
m = Line(StartPoint=end_points.Start, EndPoint=end_points.End)

# ---- group: MITER ANGLE (continued)
perp_frame = PerpFrame(Curve=m, Parameter="0.5")
deconstruct_plane_3 = DeconstructPlane(Plane=perp_frame)  # -> Origin, XAxis, YAxis, ZAxis
align_plane = AlignPlane(Plane=perp_frame, Direction=deconstruct_plane_2.XAxis)  # -> Plane, Angle
line_sdl = LineSDL(Start=deconstruct_plane_3.Origin, Direction=deconstruct_plane_2.XAxis, Length="6")
line_sdl_2 = LineSDL(Start=deconstruct_plane_3.Origin, Direction=vector_2pt_2.Vector, Length="6")
angle = Angle(VectorA=line_sdl, VectorB=line_sdl_2)  # -> Angle, Reflex
degrees = Degrees(Radians=angle.Angle)
end_points_2 = EndPoints(Curve=line_sdl)  # -> Start, End
end_points_3 = EndPoints(Curve=line_sdl_2)  # -> Start, End
angular_dimension = AngularDimension(
    Center=deconstruct_plane_3.Origin,
    PointA=end_points_2.End,
    PointB=end_points_3.End,
    Reflex=False,
    Text="{0:0.0}°",
    Size=1)
round = Round(Number=degrees)  # -> Nearest, Floor, Ceiling
miter_angle = Number(round.Nearest)

# ---- group: CHECK ANGLE
graft_tree = GraftTree(Tree=deconstruct_box.Plane, IncludeEmptyLists=True, IncludeNullItems=True)
plane_origin = PlaneOrigin(Base=graft_tree, Origin=perp_frame)
deconstruct_plane_4 = DeconstructPlane(Plane=plane_origin)  # -> Origin, XAxis, YAxis, ZAxis
construct_plane_2 = ConstructPlane(Origin=deconstruct_plane_4.Origin, XAxis=deconstruct_plane_4.XAxis, YAxis=deconstruct_plane_4.ZAxis)
rectangle_2 = Rectangle(Plane=construct_plane_2, XSize="-2 to 2", YSize="-4 to 4", Radius=0)  # -> Rectangle, Length
boundary_surfaces_2 = BoundarySurfaces(Edges=rectangle_2.Rectangle)
brep_plane_2 = BrepPlane(Brep=boundary_surfaces_2, Plane=planar.Plane)  # -> Curves, Points
shift_paths_2 = ShiftPaths(Data=brep_plane_2.Curves, Offset=-1)
clean_tree_2 = CleanTree(Tree=shift_paths_2, CleanInvalid=True, CleanEmpty=invert(False))
end_points_4 = EndPoints(Curve=clean_tree_2)  # -> Start, End
m_2 = Line(StartPoint=end_points_4.Start, EndPoint=end_points_4.End)
vector_2pt_3 = Vector2Pt(PointA=end_points_4.End, PointB=end_points_4.Start, Unitize=False)  # -> Vector, Length
tree_statistics_2 = TreeStatistics(Tree=clean_tree_2)  # -> Paths, Length, Count
tree_branch_2 = TreeBranch(Tree=construct_plane, Path=tree_statistics_2.Paths, MaintainPaths=True)
perp_frame_2 = PerpFrame(Curve=m_2, Parameter="0.5")
deconstruct_plane_5 = DeconstructPlane(Plane=tree_branch_2)  # -> Origin, XAxis, YAxis, ZAxis
deconstruct_plane_6 = DeconstructPlane(Plane=perp_frame_2)  # -> Origin, XAxis, YAxis, ZAxis
align_plane_2 = AlignPlane(Plane=perp_frame_2, Direction=deconstruct_plane_5.XAxis)  # -> Plane, Angle
line_sdl_3 = LineSDL(Start=deconstruct_plane_6.Origin, Direction=deconstruct_plane_5.XAxis, Length="3")
line_sdl_4 = LineSDL(Start=deconstruct_plane_6.Origin, Direction=vector_2pt_3.Vector, Length="3")
end_points_5 = EndPoints(Curve=line_sdl_3)  # -> Start, End
end_points_6 = EndPoints(Curve=line_sdl_4)  # -> Start, End
angle_2 = Angle(VectorA=line_sdl_3, VectorB=line_sdl_4)  # -> Angle, Reflex
angular_dimension_2 = AngularDimension(
    Center=deconstruct_plane_6.Origin,
    PointA=end_points_6.End,
    PointB=end_points_5.End,
    Reflex=False,
    Text="{0:0.0}°",
    Size=1)
degrees_2 = Degrees(Radians=angle_2.Angle)
round_2 = Round(Number=degrees_2)  # -> Nearest, Floor, Ceiling
check_angle = Number(round_2.Nearest)

# ----
panel_8 = Panel(perp_frame)
miter_angle_2 = ClusterOutput(miter_angle)
check_angle_2 = ClusterOutput(check_angle)
panel_9 = Panel(degrees_2)
panel_10 = Panel(degrees)

# ---- group: TILT ANGLE
rectangle_3 = Rectangle(Plane=perp_frame, XSize="-2 to 2", YSize="-2 to 2", Radius=0)  # -> Rectangle, Length
boundary_surfaces_3 = BoundarySurfaces(Edges=rectangle_3.Rectangle)
brep_plane_3 = BrepPlane(Brep=boundary_surfaces_3, Plane=planar.Plane)  # -> Curves, Points
shift_paths_3 = ShiftPaths(Data=brep_plane_3.Curves, Offset=-1)
clean_tree_3 = CleanTree(Tree=shift_paths_3, CleanInvalid=True, CleanEmpty=invert(False))
end_points_7 = EndPoints(Curve=clean_tree_3)  # -> Start, End
m_3 = Line(StartPoint=end_points_7.Start, EndPoint=end_points_7.End)
vector_2pt_4 = Vector2Pt(PointA=end_points_7.Start, PointB=end_points_7.End, Unitize=False)  # -> Vector, Length
tree_statistics_3 = TreeStatistics(Tree=clean_tree_3)  # -> Paths, Length, Count
tree_branch_3 = TreeBranch(Tree=construct_plane, Path=tree_statistics_3.Paths, MaintainPaths=True)
deconstruct_plane_7 = DeconstructPlane(Plane=tree_branch_3)  # -> Origin, XAxis, YAxis, ZAxis
angle_3 = Angle(VectorA=deconstruct_plane_7.XAxis, VectorB=m_3)  # -> Angle, Reflex
perp_frame_3 = PerpFrame(Curve=m_3, Parameter="0.5")
align_plane_3 = AlignPlane(Plane=perp_frame_3, Direction=deconstruct_plane_7.XAxis)  # -> Plane, Angle
degrees_3 = Degrees(Radians=angle_3.Angle)
line_sdl_5 = LineSDL(Start=deconstruct_plane_7.Origin, Direction=deconstruct_plane_7.XAxis, Length="3")
line_sdl_6 = LineSDL(Start=deconstruct_plane_7.Origin, Direction=vector_2pt_4.Vector, Length="3")
end_points_8 = EndPoints(Curve=line_sdl_5)  # -> Start, End
end_points_9 = EndPoints(Curve=line_sdl_6)  # -> Start, End
angular_dimension_3 = AngularDimension(
    Center=deconstruct_plane_7.Origin,
    PointA=end_points_8.End,
    PointB=end_points_9.End,
    Reflex=False,
    Text="{0:0.0}°",
    Size=1)

# ----
round_3 = Round(Number=degrees_3)  # -> Nearest, Floor, Ceiling
tilt_angle = Number(round_3.Nearest)

# ---- group: TILT ANGLE (continued)
panel_11 = Panel(tilt_angle)

# ----
tilt_angle_2 = ClusterOutput(tilt_angle)

# ==== cluster Cluster_8
box_before_miters = ClusterInput()
inside_curve = ClusterInput()
box_before_miters_2 = Box(box_before_miters)
inside_curve_2 = Curve(inside_curve)
edges = BrepEdges(Brep=box_before_miters_2)  # -> Naked, Interior, NonManifold
panel = Panel("""8
9
10
11""")
item = ListItem(List=edges.Interior, Index=panel, Wrap=True)
planar = Planar(Curve=inside_curve_2)  # -> Planar, Plane, Deviation
line = Line(item)
plx = LinePlane(Line=line, Plane=planar.Plane)  # -> Point, ParamL, ParamP
end = EndPoints(Curve=line)  # -> Start, End

# ---- group: FASTENER LOCATIONS
panel_2 = Panel("""0
1""")
panel_3 = Panel("""2
3""")
item_2 = ListItem(List=plx.Point, Index=panel_2, Wrap=True)
item_3 = ListItem(List=plx.Point, Index=panel_3, Wrap=True)
dispatch = Dispatch(List=item_2, DispatchPattern=[True, False])  # -> ListA, ListB
dispatch_2 = Dispatch(List=item_3, DispatchPattern=[True, False])  # -> ListA, ListB
ln = Line(StartPoint=dispatch.ListA, EndPoint=dispatch.ListB)
ln_2 = Line(StartPoint=dispatch_2.ListA, EndPoint=dispatch_2.ListB)
number = Number(0.5)
evaluate_curve = EvaluateCurve(Curve=ln, Parameter=number)  # -> Point, Tangent, Angle
evaluate_curve_2 = EvaluateCurve(Curve=ln_2, Parameter=number)  # -> Point, Tangent, Angle
vector_2pt = Vector2Pt(PointA=evaluate_curve.Point, PointB=evaluate_curve_2.Point, Unitize=False)  # -> Vector, Length
ln_3 = Line(StartPoint=evaluate_curve.Point, EndPoint=evaluate_curve_2.Point)
evaluate_curve_3 = EvaluateCurve(Curve=ln_3, Parameter=number)  # -> Point, Tangent, Angle
number_2 = Number(0.75)
neg = Negative(Value=number_2)
amplitude = Amplitude(Vector=vector_2pt.Vector, Amplitude=number_2)
amplitude_2 = Amplitude(Vector=vector_2pt.Vector, Amplitude=neg)
move = Move(Geometry=evaluate_curve_3.Point, Motion=amplitude)  # -> Geometry, Transform
move_2 = Move(Geometry=evaluate_curve_3.Point, Motion=amplitude_2)  # -> Geometry, Transform
merge = Merge(Data1=move_2.Geometry, Data2=move.Geometry)
distance = Distance(PointA=move_2.Geometry, PointB=move.Geometry)
fastener_points = Point(merge)

# ----
pt = Point(end.End)
panel_4 = Panel("""Q{0;1;2;3}
Q{4;5;6;7}""")
panel_5 = Panel("""Q{1;2;6;5}
Q{3;0;4;7}""")
panel_6 = Panel("""Q{0;1;5;4}
Q{2;3;7;6}""")
merge_2 = Merge(Data1=pt, Data2=plx.Point)
ln_4 = Line(StartPoint=pt, EndPoint=plx.Point)
conmesh = ConstructMesh(Vertices=merge_2, Faces=panel_4)
conmesh_2 = ConstructMesh(Vertices=merge_2, Faces=panel_5)
conmesh_3 = ConstructMesh(Vertices=merge_2, Faces=panel_6)
len = Length(Curve=ln_4)
sort = SortList(Keys=len, ValuesA=ln_4)  # -> Keys, ValuesA
merge_3 = Merge(Data1=conmesh, Data2=conmesh_2, Data3=conmesh_3)
item_4 = ListItem(List=reverse(sort.Keys), Index=0, Wrap=True)
item_5 = ListItem(List=reverse(sort.ValuesA), Index=0, Wrap=True)
mjoin = MeshJoin(Meshes=merge_3)
louver_meshes_with_miters = Mesh(flatten(mjoin))

# ---- group: Longest Length
longest_length = Number(flatten(item_4))

# ----
divide = DivideCurve(Curve=item_5, Count=10, Kinks=False)  # -> Points, Tangents, Parameters
mesh_pts = Point(merge_2)
louver_meshes_with_miters_2 = ClusterOutput(louver_meshes_with_miters)
mesh_pts_2 = ClusterOutput(mesh_pts)
longest_length_2 = ClusterOutput(longest_length)

series = Series(Start=0, Step=1, Count=8)
int = Integer(series)
tag = TextTag(Location=merge_2, Text=int, Colour=ColourSwatch(SwatchColor=RGB(255, 255, 255)))
preview = CustomPreview(Geometry=mjoin, Shader=ColourSwatch(SwatchColor=RGB(102, 158, 255)))

panel_7 = Panel(distance)
fastener_points_2 = ClusterOutput(fastener_points)

# ---- group: MITER ANGLE
deconstruct_box = DeconstructBox(Box=box_before_miters_2)  # -> Plane, X, Y, Z
deconstruct_plane = DeconstructPlane(Plane=deconstruct_box.Plane)  # -> Origin, XAxis, YAxis, ZAxis
construct_plane = ConstructPlane(Origin=deconstruct_plane.Origin, XAxis=deconstruct_plane.ZAxis, YAxis=deconstruct_plane.YAxis)  # -> graft(Plane)
rectangle = Rectangle(Plane=construct_plane, XSize="-48 to 48", YSize="-8 to 8", Radius=0)  # -> Rectangle, Length
boundary_surfaces = BoundarySurfaces(Edges=rectangle.Rectangle)
brep_plane = BrepPlane(Brep=boundary_surfaces, Plane=planar.Plane)  # -> Curves, Points
shift_paths = ShiftPaths(Data=brep_plane.Curves, Offset=-1)
clean_tree = CleanTree(Tree=shift_paths, CleanInvalid=True, CleanEmpty=invert(False))
end_points = EndPoints(Curve=clean_tree)  # -> Start, End
vector_2pt_2 = Vector2Pt(PointA=end_points.Start, PointB=end_points.End, Unitize=False)  # -> Vector, Length
tree_statistics = TreeStatistics(Tree=clean_tree)  # -> Paths, Length, Count
tree_branch = TreeBranch(Tree=construct_plane, Path=tree_statistics.Paths, MaintainPaths=True)
deconstruct_plane_2 = DeconstructPlane(Plane=tree_branch)  # -> Origin, XAxis, YAxis, ZAxis

# ---- group: MITER ANGLE / miter line
m = Line(StartPoint=end_points.Start, EndPoint=end_points.End)

# ---- group: MITER ANGLE (continued)
perp_frame = PerpFrame(Curve=m, Parameter="0.5")
deconstruct_plane_3 = DeconstructPlane(Plane=perp_frame)  # -> Origin, XAxis, YAxis, ZAxis
align_plane = AlignPlane(Plane=perp_frame, Direction=deconstruct_plane_2.XAxis)  # -> Plane, Angle
line_sdl = LineSDL(Start=deconstruct_plane_3.Origin, Direction=deconstruct_plane_2.XAxis, Length="6")
line_sdl_2 = LineSDL(Start=deconstruct_plane_3.Origin, Direction=vector_2pt_2.Vector, Length="6")
angle = Angle(VectorA=line_sdl, VectorB=line_sdl_2)  # -> Angle, Reflex
degrees = Degrees(Radians=angle.Angle)
end_points_2 = EndPoints(Curve=line_sdl)  # -> Start, End
end_points_3 = EndPoints(Curve=line_sdl_2)  # -> Start, End
angular_dimension = AngularDimension(
    Center=deconstruct_plane_3.Origin,
    PointA=end_points_2.End,
    PointB=end_points_3.End,
    Reflex=False,
    Text="{0:0.0}°",
    Size=1)
round = Round(Number=degrees)  # -> Nearest, Floor, Ceiling
miter_angle = Number(round.Nearest)

# ----
graft_tree = GraftTree(Tree=deconstruct_box.Plane, IncludeEmptyLists=True, IncludeNullItems=True)
plane_origin = PlaneOrigin(Base=graft_tree, Origin=perp_frame)
deconstruct_plane_4 = DeconstructPlane(Plane=plane_origin)  # -> Origin, XAxis, YAxis, ZAxis
construct_plane_2 = ConstructPlane(Origin=deconstruct_plane_4.Origin, XAxis=deconstruct_plane_4.XAxis, YAxis=deconstruct_plane_4.ZAxis)
rectangle_2 = Rectangle(Plane=construct_plane_2, XSize="-2 to 2", YSize="-4 to 4", Radius=0)  # -> Rectangle, Length
boundary_surfaces_2 = BoundarySurfaces(Edges=rectangle_2.Rectangle)
brep_plane_2 = BrepPlane(Brep=boundary_surfaces_2, Plane=planar.Plane)  # -> Curves, Points
shift_paths_2 = ShiftPaths(Data=brep_plane_2.Curves, Offset=-1)
clean_tree_2 = CleanTree(Tree=shift_paths_2, CleanInvalid=True, CleanEmpty=invert(False))
end_points_4 = EndPoints(Curve=clean_tree_2)  # -> Start, End
m_2 = Line(StartPoint=end_points_4.Start, EndPoint=end_points_4.End)
vector_2pt_3 = Vector2Pt(PointA=end_points_4.End, PointB=end_points_4.Start, Unitize=False)  # -> Vector, Length
tree_statistics_2 = TreeStatistics(Tree=clean_tree_2)  # -> Paths, Length, Count
tree_branch_2 = TreeBranch(Tree=construct_plane, Path=tree_statistics_2.Paths, MaintainPaths=True)
perp_frame_2 = PerpFrame(Curve=m_2, Parameter="0.5")
deconstruct_plane_5 = DeconstructPlane(Plane=tree_branch_2)  # -> Origin, XAxis, YAxis, ZAxis
deconstruct_plane_6 = DeconstructPlane(Plane=perp_frame_2)  # -> Origin, XAxis, YAxis, ZAxis
align_plane_2 = AlignPlane(Plane=perp_frame_2, Direction=deconstruct_plane_5.XAxis)  # -> Plane, Angle
line_sdl_3 = LineSDL(Start=deconstruct_plane_6.Origin, Direction=deconstruct_plane_5.XAxis, Length="3")
line_sdl_4 = LineSDL(Start=deconstruct_plane_6.Origin, Direction=vector_2pt_3.Vector, Length="3")
angle_2 = Angle(VectorA=line_sdl_3, VectorB=line_sdl_4)  # -> Angle, Reflex
degrees_2 = Degrees(Radians=angle_2.Angle)
end_points_5 = EndPoints(Curve=line_sdl_3)  # -> Start, End
end_points_6 = EndPoints(Curve=line_sdl_4)  # -> Start, End
angular_dimension_2 = AngularDimension(
    Center=deconstruct_plane_6.Origin,
    PointA=end_points_6.End,
    PointB=end_points_5.End,
    Reflex=False,
    Text="{0:0.0}°",
    Size=1)
round_2 = Round(Number=degrees_2)  # -> Nearest, Floor, Ceiling
check_angle = Number(round_2.Nearest)

panel_8 = Panel(perp_frame)
check_angle_2 = ClusterOutput(check_angle)
miter_angle_2 = ClusterOutput(miter_angle)
panel_9 = Panel(degrees_2)
panel_10 = Panel(degrees)

# ---- group: TILT ANGLE
rectangle_3 = Rectangle(Plane=perp_frame, XSize="-2 to 2", YSize="-2 to 2", Radius=0)  # -> Rectangle, Length
boundary_surfaces_3 = BoundarySurfaces(Edges=rectangle_3.Rectangle)
brep_plane_3 = BrepPlane(Brep=boundary_surfaces_3, Plane=planar.Plane)  # -> Curves, Points
shift_paths_3 = ShiftPaths(Data=brep_plane_3.Curves, Offset=-1)
clean_tree_3 = CleanTree(Tree=shift_paths_3, CleanInvalid=True, CleanEmpty=invert(False))
end_points_7 = EndPoints(Curve=clean_tree_3)  # -> Start, End
m_3 = Line(StartPoint=end_points_7.Start, EndPoint=end_points_7.End)
vector_2pt_4 = Vector2Pt(PointA=end_points_7.Start, PointB=end_points_7.End, Unitize=False)  # -> Vector, Length
tree_statistics_3 = TreeStatistics(Tree=clean_tree_3)  # -> Paths, Length, Count
tree_branch_3 = TreeBranch(Tree=construct_plane, Path=tree_statistics_3.Paths, MaintainPaths=True)
deconstruct_plane_7 = DeconstructPlane(Plane=tree_branch_3)  # -> Origin, XAxis, YAxis, ZAxis
angle_3 = Angle(VectorA=deconstruct_plane_7.XAxis, VectorB=m_3)  # -> Angle, Reflex
perp_frame_3 = PerpFrame(Curve=m_3, Parameter="0.5")
align_plane_3 = AlignPlane(Plane=perp_frame_3, Direction=deconstruct_plane_7.XAxis)  # -> Plane, Angle
degrees_3 = Degrees(Radians=angle_3.Angle)
line_sdl_5 = LineSDL(Start=deconstruct_plane_7.Origin, Direction=deconstruct_plane_7.XAxis, Length="3")
line_sdl_6 = LineSDL(Start=deconstruct_plane_7.Origin, Direction=vector_2pt_4.Vector, Length="3")
end_points_8 = EndPoints(Curve=line_sdl_5)  # -> Start, End
end_points_9 = EndPoints(Curve=line_sdl_6)  # -> Start, End
angular_dimension_3 = AngularDimension(
    Center=deconstruct_plane_7.Origin,
    PointA=end_points_8.End,
    PointB=end_points_9.End,
    Reflex=False,
    Text="{0:0.0}°",
    Size=1)

# ----
round_3 = Round(Number=degrees_3)  # -> Nearest, Floor, Ceiling
tilt_angle = Number(round_3.Nearest)

# ---- group: TILT ANGLE (continued)
panel_11 = Panel(tilt_angle)

# ----
tilt_angle_2 = ClusterOutput(tilt_angle)

# ==== cluster Cluster_9
center_pipe_curve = ClusterInput()
outside_curve_a = ClusterInput()
a_planes = ClusterInput()
outside_curve_d = ClusterInput()
d_planes = ClusterInput()
center_pipe_curve_2 = Curve(center_pipe_curve)
outside_curve_a_2 = Curve(outside_curve_a)
a_planes_2 = Plane(a_planes)
outside_curve_d_2 = Curve(outside_curve_d)
d_planes_2 = Plane(d_planes)
curve_plane = CurvePlane(Curve=outside_curve_a_2, Plane=a_planes_2)  # -> Points, ParamsC, ParamsP
curve_plane_2 = CurvePlane(Curve=outside_curve_d_2, Plane=d_planes_2)  # -> Points, ParamsC, ParamsP
panel = Panel("""0
5
10
15
20
25
30
35
40
45
50
55
60""")
curve_plane_3 = CurvePlane(Curve=center_pipe_curve_2, Plane=a_planes_2)  # -> Points, ParamsC, ParamsP
curve_plane_4 = CurvePlane(Curve=center_pipe_curve_2, Plane=d_planes_2)  # -> Points, ParamsC, ParamsP
line = Line(StartPoint=curve_plane.Points, EndPoint=curve_plane_3.Points)  # -> flatten(Line)
list_item = ListItem(List=line, Index=panel, Wrap=True)
line_2 = Line(StartPoint=curve_plane_2.Points, EndPoint=curve_plane_4.Points)  # -> flatten(Line)
list_item_2 = ListItem(List=line_2, Index=panel, Wrap=True)
merge = Merge(Data1=list_item, Data2=list_item_2)
number = Number(1.1875)
curve = Curve(line)
curve_2 = Curve(line_2)
pipe = Pipe(Curve=merge, Radius=number, Caps=0)
diagonal_struts = Brep(pipe)
strut_center_lines = Curve(merge)
diagonal_struts_2 = ClusterOutput(diagonal_struts)
strut_center_lines_2 = ClusterOutput(strut_center_lines)

# ==== cluster Cluster_11
crv = ClusterInput()
gap = ClusterInput()
len = Length(Curve=crv)
gap_2 = Number(gap)
subtraction = Subtraction(A=len, B=gap_2)
dom = ConstructDomain(DomainStart=expr("x * -0.5", subtraction), DomainEnd=expr("x * 0.5", subtraction))
dom_2 = ConstructDomain(DomainStart=0, DomainEnd=subtraction)
Z = ClusterOutput(dom_2)

# ==== cluster Cluster_12
first_pt = ClusterInput()
spacing_between_fronds = ClusterInput()
spine_gap = ClusterInput()
louver_cl = ClusterInput()
first_pt_2 = Point(first_pt)
spacing_between_fronds_2 = Number(spacing_between_fronds)
louver_cl_2 = Line(louver_cl)
spine_gap_2 = Number(spine_gap)
viewer = ParamViewer(louver_cl_2)
lng = ListLength(List=viewer)
series = Series(Start=0, Step=spacing_between_fronds_2, Count=expr("x / 2", lng))
xy = XYPlane(Origin=first_pt_2)
X = UnitX(Factor=spine_gap_2)
move = Move(Geometry=xy, Motion=X)  # -> Geometry, Transform
X_2 = UnitX(Factor=series)
move_2 = Move(Geometry=xy, Motion=X_2)  # -> Geometry, Transform
move_3 = Move(Geometry=move.Geometry, Motion=X_2)  # -> Geometry, Transform
weave = Weave(Pattern=[0, 1], Stream0=move_2.Geometry, Stream1=move_3.Geometry, NullGaps=False)  # -> graft(Weave)

pt = Point(weave)
viewer_2 = ParamViewer(pt)
path = DataPath(viewer)
replace = ReplacePaths(Data=pt, Search=viewer_2, Replace=path)
frond_pts = Point(replace)

frond_pts_2 = ClusterOutput(frond_pts)
